# Grasshopper definition ABB_GoFa_robot_playground_012_mg.gh (Grasshopper 1.0.7)

# ---- group: TFRAME : measuringtip_mg_01_220628
x = Panel("-0.325569")
y = Panel("1.09274")
z = Panel("67.2126")
q3 = Panel("0")
mass = Panel("0.5")
q1 = Panel("1")

# ---- group: WOBJ : table_mg_01_220628
x_2 = Panel("574.029")
y_2 = Panel("-419.762")
z_2 = Panel("0.311546")
q1_2 = Panel("0.706315")
q2_2 = Panel("0.000442226")
q3_2 = Panel("-0.000397702")
q4_2 = Panel("0.707897")

# ----
tool = AttachedTool()  # -> robot; inputs visual_mesh: Mesh, collision_mesh: Mesh
#   port visual_mesh: A visual mesh for the tool.
#   port collision_mesh: A collision mesh for the tool.
#   port tcf_plane: The frame of the tool in tool0 frame.
# ---------- tool: Python ----------
"""
Attach a tool to the robot.

COMPAS FAB v0.25.0
"""
from ghpythonlib.componentbase import executingcomponent as component
from compas_rhino.conversions import RhinoMesh
from compas_rhino.conversions import plane_to_compas_frame

from compas.geometry import Frame
from compas_fab.robots import PlanningScene
from compas_fab.robots import Tool


class AttachToolComponent(component):
    def RunScript(self, robot, visual_mesh, collision_mesh, tcf_plane):
        if robot and robot.client and robot.client.is_connected and visual_mesh:
            if not collision_mesh:
                collision_mesh = visual_mesh

            c_visual_mesh = RhinoMesh.from_geometry(visual_mesh).to_compas()
            c_collision_mesh = RhinoMesh.from_geometry(collision_mesh).to_compas()

            if not tcf_plane:
                frame = Frame.worldXY()
            else:
                frame = plane_to_compas_frame(tcf_plane)
            tool = Tool(c_visual_mesh, frame, c_collision_mesh)

            scene = PlanningScene(robot)
            robot.attach_tool(tool)
            scene.add_attached_tool()

        return robot
# ---------- end tool ----------
python = GhPythonScript(x=x_2, y=y_2, z=z_2, q1=q1_2, q2=q2_2, q3=q3_2, q4=q4_2)  # -> out, wobj_frame, wobj_plane
# ---------- python: Python ----------
from compas.geometry import Frame
from compas_ghpython import draw_frame

origin = (x, y, z)

wobj_frame = Frame.from_quaternion([q1, q2, q3, q4], origin)
wobj_plane = draw_frame(wobj_frame)
# ---------- end python ----------
pln = Plane(python.wobj_plane)
deplane = DeconstructPlane(Plane=pln)  # -> Origin, XAxis, YAxis, ZAxis
rev = Reverse(Vector=deplane.YAxis)
pl = ConstructPlane(Origin=deplane.Origin, XAxis=rev, YAxis=deplane.XAxis)
table_geometry = Brep(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)

# ---- group: ROS client
# ROS client - MoveIt
disconnect = Button()
# Robot
panel = Panel("128.178.91.174")
connect = Button()
restart = Button()
ros = PythonScript(ip=panel, restart=restart)  # -> out, ros_client
# ---------- ros: Python ----------
import sys
import time
import logging
import scriptcontext as sc

from compas_fab.backends import RosClient

from System import TimeSpan
from System.Threading import ManualResetEventSlim

LOGGER = logging.getLogger('roslibpy')

key = 'rosclient_%s' % str(ghenv.Component.InstanceGuid)
previous_client = sc.sticky.get(key, None)
if previous_client:
    previous_client.terminate()

ros_client = RosClient(ip, 9090)
sc.sticky[key] = ros_client

waitLock = ManualResetEventSlim(False)

ros_client.on_ready(lambda: waitLock.Set())

if not waitLock.Wait(TimeSpan.FromSeconds(5)):
    raise Exception('Unable to connect to ROS')

LOGGER.info('ROS connection opened')
# ---------- end ros ----------
connect_2 = PythonScript(ros_client=ros.ros_client, connect=connect, disconnect=disconnect)  # -> out, ros_client
# ---------- connect_2: Python ----------
import logging
from System import TimeSpan
from System.Threading import ManualResetEventSlim

LOGGER = logging.getLogger('roslibpy')

if connect:
    if not ros_client.is_connected:
        LOGGER.debug('Connecting...')
        waitLock = ManualResetEventSlim(False)
        ros_client.on_ready(lambda: waitLock.Set())
        ros_client.connect()

        if not waitLock.Wait(TimeSpan.FromSeconds(5)):
            raise Exception('Unable to connect to ROS')
        LOGGER.debug('Reconnected')

if disconnect:
    if ros_client.is_connected:
        ros_client.terminate()
        LOGGER.debug('Terminated')

print ros_client.is_connected
# ---------- end connect_2 ----------
is_connected = Panel(connect_2.out)

# ----
# Load robot directly from ROS
# (only working if connected, and ROS Bridge, File_server, and demo.launch are running on the ROS machine)
load = Button()
units = ValueList({"m": 1, "cm": 100, "mm": 1000}, selected="mm")
python_2 = PythonScript(client=connect_2.ros_client, scale_factor=units, load=load)  # -> robot; inputs load: Boolean
# ---------- python_2: Python ----------
import os
from scriptcontext import sticky as st
import compas
from compas.robots import RobotModel
from compas_fab.backends import RosClient
from compas_fab.backends import RosFileServerLoader
from compas_fab.robots import Robot
from compas_fab.robots import RobotSemantics
from compas_ghpython.artists import RobotModelArtist

# Set high precision to import meshes defined in meters
compas.PRECISION = '24f'

# store robot in component
guid = str(ghenv.Component.InstanceGuid)
robot_key = "robot_" + guid

if robot_key not in st:
    st[robot_key] = None

if client and client.is_connected and load:
    # Load URDF from ROS
    loader = RosFileServerLoader(client)
    urdf = loader.load_urdf()
    srdf = loader.load_srdf()

    # Create robot model from URDF and load geometry
    model = RobotModel.from_urdf_string(urdf)
    model.load_geometry(loader)

    semantics = RobotSemantics.from_srdf_string(srdf, model)

    robot = Robot(model, semantics=semantics)
    robot.artist = RobotModelArtist(robot.model)
    robot.scale(scale_factor)
    st[robot_key] = robot

robot = st[robot_key]
if robot:
    robot.client = client
# ---------- end python_2 ----------
robot = Data(python_2)

orient = Orient(Geometry=table_geometry, Source=PlaneXY(0, 0, 0), Target=pl)  # -> Geometry, Transform

# ----
# Planning scene
# Pass collision objects to planning scene
# Select the links the object is allowed to touch
scene = PythonScript(robot=robot)  # -> scene
# ---------- scene: Python ----------
from scriptcontext import sticky as st

from compas_fab.robots import PlanningScene

# store scene in component
guid = str(ghenv.Component.InstanceGuid)
scene_key = "scene_" + guid

if scene_key not in st:
    st[scene_key] = None

if robot:
    st[scene_key] = PlanningScene(robot)

scene = st[scene_key]
# ---------- end scene ----------
idxs = Data([3, 4, 5, 6, 7])  # disabled
py = PythonScript(robot=robot, idxs=idxs)  # -> touch_links; inputs idxs: list of Int32; disabled
# ---------- py: Python ----------
if robot:
    link_names = robot.get_link_names()
    touch_links = [link_names[i] for i in idxs]
# ---------- end py ----------
panel_2 = Panel(py)  # disabled

# ---- group: Static Collision Mesh
panel_3 = Panel("Define an obstacle")
mesh = Mesh(orient.Geometry)
preview = CustomPreview(Geometry=orient.Geometry, Shader=ColourSwatch(SwatchColor=RGBA(255, 0, 0, 150)))
mesh_2 = PythonScript(mesh=mesh)  # -> compas_mesh
# ---------- mesh_2: Python ----------
from compas.datastructures import Mesh
from compas_rhino.geometry import RhinoMesh

compas_mesh = RhinoMesh.from_guid(mesh).to_compas()
# ---------- end mesh_2 ----------
scale = BooleanToggle(True)
remove = Button()
add = Button()
collision = PythonScript(scene=scene, compas_mesh=mesh_2, scale=scale, id="table", add=add, remove=remove)  # -> out
# ---------- collision: Python ----------
from compas_fab.robots import CollisionMesh

cm = CollisionMesh(compas_mesh, id)

if scene:
    if add:
        scene.add_collision_mesh(cm, scale)
    if remove:
        scene.remove_collision_mesh(id)
        
print(scene)
# ---------- end collision ----------
panel_4 = Panel(collision)

# ---- group: Attached Collision Mesh
# Attach an collision object
# Select link name to attach
yz = YZPlane(Origin=Point(0, 0, 0))  # disabled
cone = Cone(Base=yz, Radius=0.035, Length=0.1)  # -> Cone, Tip; disabled
mesh_3 = Mesh(cone.Cone)  # disabled
mesh_4 = PythonScript(mesh=mesh_3)  # -> compas_mesh; disabled; same code as mesh_2
number_slider = Slider(4, range=0..7)  # disabled
py_2 = PythonScript(robot=robot, idx=number_slider)  # -> link_name; inputs idx: Int32; disabled
# ---------- py_2: Python ----------
if robot:
    link_names = robot.get_link_names()
    link_name = link_names[idx]
# ---------- end py_2 ----------
panel_5 = Panel(py_2)  # disabled
remove_2 = Button()  # disabled
scale_2 = BooleanToggle(False)  # disabled
add_2 = Button()  # disabled
panel_6 = Panel("tip")  # disabled
attached = PythonScript(scene=scene, compas_mesh=mesh_4, scale=scale_2, id=panel_6, link_name=py_2, touch_links=py, add=add_2, remove=remove_2)  # -> acm, out; inputs touch_links: list; disabled
# ---------- attached: Python ----------
from compas_fab.robots import CollisionMesh
from compas_fab.robots import AttachedCollisionMesh

cm = CollisionMesh(compas_mesh, id)
acm = AttachedCollisionMesh(cm, link_name, touch_links)

if scene:
    if add:
        scene.add_attached_collision_mesh(acm, scale)
    if remove:
        scene.remove_attached_collision_mesh(id)
        scene.remove_collision_mesh(id)
# ---------- end attached ----------

# ----
# Robot Info
info = PythonScript(robot=robot)  # -> out, main_group_name
# ---------- info: Python ----------
if robot:
    robot.info()
    main_group_name = robot.main_group_name
# ---------- end info ----------
panel_7 = Panel(info.out)

toggle = BooleanToggle(False)

# ----
# Input
panel_8 = Panel("End plane")
pt = Point(<point referenced from the Rhino model>)
panel_9 = Panel("Start plane")
pt_2 = Point(<point referenced from the Rhino model>)
py_3 = GhPythonScript(pt=pt)  # -> pln
# ---------- py_3: Python ----------
import Rhino.Geometry as rg

pln = rg.Plane(pt, -rg.Vector3d.ZAxis)
# ---------- end py_3 ----------
py_4 = GhPythonScript(pt=pt_2)  # -> pln; same code as py_3
end_plane = Plane(py_3)
start_plane = Plane(py_4)

# ---- group: inverse kinematics / not working
avoid_collisions = BooleanToggle(True)

# ----
load_presets = Button()
jp = GhPythonScript()  # -> joint_positions_1
# ---------- jp: Python ----------
import math
joint_positions_1 = [0, math.radians(16), math.radians(23), 0, math.radians(52), 0]

print joint_positions_1
# ---------- end jp ----------
zero_configuration = PythonScript(robot=robot)  # -> full_zero_configuration
# ---------- zero_configuration: Python ----------
from compas_fab.robots import Configuration

if robot:
    types = robot.get_configurable_joint_types()
    values = [0] * len(types)
    full_zero_configuration = Configuration(values, types)
    print full_zero_configuration
    print robot.get_configurable_joint_names()
# ---------- end zero_configuration ----------
pln_2 = Plane(start_plane)
zero_configuration_2 = PythonScript(robot=robot)  # -> full_zero_configuration; same code as zero_configuration
division = Division(A="1", B=units)

# ---- group: CURRENT CUSTOM INSTRUCTIONS
list = ValueList({"Move to Joints (MoveAbsJ)": r_RRC_MoveToJoints, "Move to (MoveL or MoveJ)": r_RRC_MoveTo, "Set analog output (SetAO)": r_RRC_SetAnalog, "Read ananlog input ((AInput)": r_RRC_ReadAnalog, "Set group output (SetGO)": r_RRC_SetGroup, "Read group input (GInput)": r_RRC_ReadGroup, "Set digital output (SetDO)": r_RRC_SetDigital, "Pulse digital output (PulsDo)": r_RRC_PulseDigital, "Read digital input (DInput)": r_RRC_ReadDigital, "Set tool (tooldata)": r_RRC_SetTool, "Set work object (wobjdata)": r_RRC_SetWorkObject, "Get robtarget (CRobT)": r_RRC_GetRobtarget, "Get joints (CJoinT)": r_RRC_GetJoints, "Start Stopwatch (ClkStart)": r_RRC_StartWatch, "Stop Stopwatch (ClkStop)": r_RRC_StopWatch, "Read Watch (ClkRead)": r_RRC_ReadWatch, "Stop (Stop)": r_RRC_Stop, "Wait time (WaitTime)": r_RRC_WaitTime, "Set maximal speed (VelSet)": r_RRC_SetMaxSpeed, "Set acceleration (AccSet)": r_RRC_SetAcceleration, "Print text (TPWrite)": r_RRC_PrintText, "No opteration": r_RRC_Noop, "Custom Instruction": r_RRC_CustomInstruction}, selected="Move to Joints (MoveAbsJ)")

# ----
list_2 = ValueList({"0 forward_kinematics": 0, "1 inverse_kinematics": 1, "2 cartesian motion": 2, "3 free-space motion": 3, "4 current position": 4}, selected="0 forward_kinematics")

# ---- group: Commands
list_3 = ValueList({"SetAcceleration", "SetMaxSpeed", "SetTool", "SetWorkObject", "MoveToJoints", "MoveToFrame", "MoveToRobtarget", "Motion", "Zone", "GetFrame", "GetJoints", "GetRobtarget", "ReadAnalog", "ReadDigital", "ReadGroup", "SetAnalog", "SetDigital", "SetGroup", "PulseDigital", "Noop", "PrintText", "Stop", "WaitTime", "ReadWatch", "StartWatch", "StopWatch"}, selected="ReadAnalog")

# ----
reload = Button()

# ---- group: unload modules!
# TESTED WITH:
# compas = 1.6.3
# compas_fab = 0.17.0
python_script = PythonScript(reload=reload)  # -> out; inputs reload: Boolean
# ---------- python_script: Python ----------
#import os
#import sys
from compas_rhino.utilities.misc import get_tolerance
from compas_rhino.utilities.misc import unload_modules

if reload:
    #print "reloading..."
    unload_modules("compas")
    unload_modules("compas_fab")
    unload_modules("compas_rrc")
    unload_modules("roslibpy")



import compas
import compas_fab
import compas_bootstrapper
import compas_rrc
print "environment =", compas_bootstrapper.ENVIRONMENT_NAME
print "compas =", compas.__version__
print "compas_fab =", compas_fab.__version__
#print compas_fab.__file__
# ---------- end python_script ----------
panel_10 = Panel(python_script)

# ----
restart_2 = Button()

# ---- group: ROS client - Sending to physical robot through server
# ROS client
disconnect_2 = Button()
connect_3 = Button()
ros_2 = PythonScript(ip="128.178.91.110", restart=restart_2)  # -> out, ros_client; same code as ros
connect_4 = PythonScript(ros_client=ros_2.ros_client, connect=connect_3, disconnect=disconnect_2)  # -> out, ros_client; same code as connect_2
is_connected_2 = Panel(connect_4.out)

# ----
# Get current configuration
button = Button()
python_3 = GhPythonScript()  # -> out, x
# ---------- python_3: Python ----------
class X:
    
    joints = []
    

x = X()
# ---------- end python_3 ----------
python_4 = GhPythonScript(x=python_3.x, robot=robot, ros=ros_2.ros_client, run=button)  # -> out, current_configuration, full_current_configuration
# ---------- python_4: Python ----------
import compas_rrc as rrc
from compas.robots import Joint
from compas_rrc import RobotJoints
from compas_fab.robots import Configuration
import math

if run:
    abb = rrc.AbbClient(ros, '/rob1')
    print('Connected.')

    joints = abb.send_and_wait(rrc.GetJoints(), timeout = 5)
    print("printed joints config",joints)
    joint_positions = joints[0]
    joint_positions_r = [math.radians(n) for n in joint_positions] 
    joint_types = robot.get_configurable_joint_types()
    
    full_current_configuration = Configuration(joint_positions_r, joint_types)
    
    x.joints = full_current_configuration

current_configuration = x.joints    
print current_configuration
# ---------- end python_4 ----------

rec = DataRecorder(python_4.full_current_configuration, DataLimit=-10, RecordData=True)
rec_2 = DataRecorder(python_4.out, DataLimit=-10, RecordData=True)

convert_config_to_plane = GhPythonScript(configuration=python_4.current_configuration, save_plane=Button(), robot=robot)  # -> out, plane
# ---------- convert_config_to_plane: Python ----------
import compas.robots
import compas.geometry
from compas_ghpython import draw_frame


if save_plane:
    compas_frame = robot.forward_kinematics(configuration)
    plane = draw_frame(compas_frame)
# ---------- end convert_config_to_plane ----------
pln_3 = Plane(convert_config_to_plane.plane)
rec_3 = DataRecorder(pln_3, DataLimit=-10, RecordData=True)
clean = CleanTree(RemoveNulls=True, RemoveInvalid=True, RemoveEmpty=False, Tree=rec_3)
panel_11 = Panel(rec_2)
panel_12 = Panel(clean)

rec_4 = DataRecorder(python_4.current_configuration, DataLimit=-10, RecordData=True)
item = ListItem(List=reverse(flatten(clean)), Index=0, Wrap=True)
clean_2 = CleanTree(RemoveNulls=True, RemoveInvalid=True, RemoveEmpty=False, Tree=rec)
item_2 = ListItem(List=reverse(flatten(clean_2)), Index=0, Wrap=True)
current_configuration = Data(python_4.current_configuration)
current_configuration_2 = Data(python_4.current_configuration)

# ---- group: inverse kinematics
zero_configuration_3 = PythonScript(robot=robot)  # -> full_zero_configuration; same code as zero_configuration
list_4 = ValueList({"current configuration": 0, "zero configuration": 1}, selected="current configuration")
current_configuration_3 = Data(python_4.current_configuration)
filter = StreamFilter(Gate=list_4, Stream0=current_configuration_3, Stream1=zero_configuration_3)

# ----
# Configuration
# TODO Example:
# Add path constraints
main_planning_group = Text(info.main_group_name)
compute = Button()
idx = Slider(1, range=0..1)

# ---- group: forward kinematics
a1 = Slider(0, range=-180..180)
a2 = Slider(0, range=-360..360)
a3 = Slider(0, range=-360..360)
a4 = Slider(0, range=-360..360)
a5 = Slider(0, range=-360..360)
a6 = Slider(0, range=-360..360)
jp_2 = GhPythonScript()  # -> all_joint_value_zero
# ---------- jp_2: Python ----------
import math
all_joint_value_zero = [0] * 6
print all_joint_value_zero
# ---------- end jp_2 ----------
forward_kinematics = PythonScript(robot=robot, set_joint_positions=load_presets, joint_positions=jp_2, a1=a1, a2=a2, a3=a3, a4=a4, a5=a5, a6=a6)  # -> full_configuration; inputs joint_positions: list
# ---------- forward_kinematics: Python ----------
import math
import Grasshopper
from compas.robots import Joint
from compas_fab.robots import Configuration

if set_joint_positions:

    j = 0
    for i in range(ghenv.Component.Params.Input.Count):
        nslider = ghenv.Component.Params.Input[i].Sources[0]
        if nslider.GetType() == Grasshopper.Kernel.Special.GH_NumberSlider:
            nslider.TrySetSliderValue(math.degrees(joint_positions[j]))
            j += 1

if robot:
    joint_positions = [a1, a2, a3, a4, a5, a6]
    joint_types = robot.get_configurable_joint_types()
    for i, joint_type in enumerate(joint_types):
        if joint_type == Joint.REVOLUTE:
            joint_positions[i] = math.radians(joint_positions[i])
    full_configuration = Configuration(joint_positions, joint_types)
# ---------- end forward_kinematics ----------
forward = PythonScript(robot=robot, group=main_planning_group, full_configuration=forward_kinematics, scale_factor=units)  # -> out, frame_WCF, plane_WCF
# ---------- forward: Python ----------
"""Calculate the robot's forward kinematic.
    Inputs:
        robot: :class:`compas_fab.robots.Robot`
            The robot.
        group: str, optional
            The planning group used for calculation. Defaults to the robot's
            main planning group.
        full_configuration : :class:`compas_fab.robots.Configuration`
            The full configuration to calculate the forward kinematic for. If no
            full configuration is passed, the zero-joint state for the other
            configurable joints is assumed.
    Output:
        :class:`Frame`
            The frame in the world coordinate frame (WCF).
"""
from __future__ import print_function
from compas_ghpython import draw_frame
from compas.geometry import Scale
from compas.geometry import Frame
from compas.geometry import Point
from compas.geometry import Transformation
import logging

LOGGER = logging.getLogger('roslibpy')

if robot and robot.client and full_configuration:
    if robot.client.is_connected:
        frame_WCF_no_scale = robot.forward_kinematics(full_configuration, group, options={'solver':'model'})
        scale_multiplier = 1/scale_factor
        scaling_transformation = Scale.from_factors([scale_multiplier] * 3)
        frame_WCF = frame_WCF_no_scale.transformed(scaling_transformation)
        print(frame_WCF)
        plane_WCF = draw_frame(frame_WCF)
    else:
        print("Robot is not connected")
# ---------- end forward ----------
pln_4 = Plane(forward.plane_WCF)
panel_13 = Panel(forward.out)

# ---- group: inverse kinematics (continued)
inverse = GhPythonScript(robot=robot, group=main_planning_group, plane=pln_2, start_configuration=filter, avoid_collisions=avoid_collisions)  # -> out, group_configuration, full_configuration
# ---------- inverse: Python ----------
"""Calculate the robot's inverse kinematic for a given plane.
    Inputs:
        robot: The robot
        group: str, optional
            The planning group used for calculation. Defaults to the robot's
            main planning group.
        plane: The plane in world coordinate frame to calculate the inverse for.
        start_configuration: :class:`compas_fab.robots.Configuration`, optional
            If passed, the inverse will be calculated such that the calculated
            joint positions differ the least from the start_configuration.
            Defaults to the zero configuration.
        avoid_collisions: bool, optional
            Whether or not to avoid collisions. Defaults to True.
    Output:
        group_configuration: The group configuration
        full_configuration: The full configuration
"""
from __future__ import print_function
import logging

from compas.geometry import Frame

LOGGER = logging.getLogger('roslibpy')

frame = Frame(plane.Origin, plane.XAxis, plane.YAxis)

if robot and robot.client:
    if robot.client.is_connected:
        full_configuration = robot.inverse_kinematics(frame,
                                                      start_configuration,
                                                      group=group,
                                                      return_full_configuration=True,
                                                      options={
                                                        'avoid_collisions':avoid_collisions,
                                                      })
        group_configuration = robot.get_group_configuration(group, full_configuration)
        print(group_configuration)
    else:
        print("Robot client is not connected")
# ---------- end inverse ----------
panel_14 = Panel(inverse.out)

# ---- group: cartesian motion
# Plan cartesian motion
group = Data(main_planning_group)
compute_2 = Button()
list_5 = ValueList({"don't use attached collision mesh": 0, "use attached collision mesh": 1}, selected="don't use attached collision mesh")
list_6 = ValueList({"current configuration": 0, "zero configuration": 1}, selected="current configuration")
py_5 = PythonScript(start_plane=start_plane, end_plane=end_plane)  # -> planes
# ---------- py_5: Python ----------
planes = [start_plane, end_plane]
print planes
# ---------- end py_5 ----------
avoid_collisions_2 = BooleanToggle(True)
filter_2 = StreamFilter(Gate=list_6, Stream0=current_configuration, Stream1=zero_configuration)
filter_3 = StreamFilter(Gate=list_5, Stream1=attached.acm)
plan_cartesian_motion = PythonScript(
    robot=robot,
    group=group,
    planes=py_5,
    start_configuration=filter_2,
    max_step=Slider(0.01, range=0..0.01),
    avoid_collisions=avoid_collisions_2,
    attached_collision_meshes=filter_3,
    compute=compute_2)  # -> out, trajectory; inputs planes: list, avoid_collisions: Boolean, attached_collision_meshes: list
# ---------- plan_cartesian_motion: Python ----------
"""Calculates a cartesian motion path (linear in tool space).
    Inputs:
        robot: The robot
        group: str, optional
            The planning group used for calculation. Defaults to the robot's
            main planning group.
        planes: The planes in world coordinate frame through which the path is defined.
        start_configuration: :class:`compas_fab.robots.Configuration`, optional
            The robot's full configuration, i.e. values for all configurable
            joints of the entire robot cell, at the starting position. Defaults
            to the all-zero configuration.
        max_step: float
            The approximate distance between the calculated points. (Defined in
            the robot's units)
        avoid_collisions: bool, optional
            Whether or not to avoid collisions. Defaults to True.
        attached_collision_meshes: list of :class:`compas_fab.robots.AttachedCollisionMesh`
            Defaults to None.
        compute: bool
            Press to calculate solution.
    Output:
        :class:`compas_fab.robots.JointTrajectory`
            The calculated trajectory.
"""
from __future__ import print_function
import logging
import scriptcontext as sc

from compas.geometry import Frame

LOGGER = logging.getLogger('roslibpy')

guid = str(ghenv.Component.InstanceGuid)
response_key = "response_" + guid
if response_key not in sc.sticky:
    sc.sticky[response_key] = None

frames = [Frame(plane.Origin, plane.XAxis, plane.YAxis) for plane in planes]

if robot and robot.client and start_configuration and compute:
    if robot.client.is_connected:
        sc.sticky[response_key] = robot.plan_cartesian_motion(frames,
                                                              start_configuration=start_configuration,
                                                              group=group,
                                                              options={
                                                                'max_step': float(max_step),
                                                                'avoid_collisions': bool(avoid_collisions),
                                                                'attached_collision_meshes': list(attached_collision_meshes),
                                                              })
    else:
        print("Robot client is not connected")

trajectory = sc.sticky[response_key]
# ---------- end plan_cartesian_motion ----------
vis = PythonScript(response=plan_cartesian_motion.trajectory)  # -> P, V, A
# ---------- vis: Python ----------
from compas_ghpython import list_to_ghtree

if response:

    positions = []
    velocities = []
    accelerations = []

    for p in response.points:
        positions.append(p.positions)
        velocities.append(p.velocities)
        accelerations.append(p.accelerations)

    P = list_to_ghtree(list(zip(*positions)))
    V = list_to_ghtree(list(zip(*velocities)))
    A = list_to_ghtree(list(zip(*accelerations)))
# ---------- end vis ----------
prismatic = QuickGraph(vis.P, SortOrder=0)
panel_15 = Panel("positions")
panel_16 = Panel(plan_cartesian_motion.out)
py_6 = PythonScript(robot=robot, group=group, trajectory=plan_cartesian_motion.trajectory)  # -> configurations, full_configurations, fraction, time
# ---------- py_6: Python ----------
if trajectory:
    configurations = trajectory.points
    full_configurations = [robot.merge_group_with_full_configuration(c, trajectory.start_configuration, group) for c in configurations]
    start_configuration = trajectory.start_configuration
    fraction = trajectory.fraction
    time = trajectory.time_from_start
# ---------- end py_6 ----------
time_s = Panel(py_6.time)
fraction = Panel(py_6.fraction)
graph = QuickGraph(vis.V, SortOrder=0)
graph_2 = QuickGraph(vis.A, SortOrder=0)
panel_17 = Panel("velocities")
panel_18 = Panel("accelerations")
idx_2 = Slider(1, range=0..1)
path = GhPythonScript(robot=robot, group=group, full_configurations=py_6.full_configurations)  # -> frames, P; inputs full_configurations: list
# ---------- path: Python ----------
import Rhino.Geometry as rg

frames = []

if robot:
    for c in full_configurations:
        if c:
            frame_WCF = robot.forward_kinematics(c, group, options={'solver':'model'})
            frames.append(frame_WCF)

    P = [rg.Point3d(*list(frame.point)) for frame in frames]
# ---------- end path ----------
animate = PythonScript(robot=robot, group=main_planning_group, configurations=py_6.full_configurations, idx=idx_2)  # -> configuration; inputs configurations: list, idx: Int32
# ---------- animate: Python ----------
import Grasshopper
from compas_fab.utilities import map_range
from compas_fab.robots import Configuration

count = len(configurations)

for i in range(ghenv.Component.Params.Input.Count):
    nslider = ghenv.Component.Params.Input[i].Sources[0]
    if nslider.GetType() == Grasshopper.Kernel.Special.GH_NumberSlider and nslider.NickName == 'idx':
        nslider.Slider.Maximum = max(count - 1, 1)
        nslider.Slider.Minimum = 0

if count and robot and configurations[0] != None:
    configuration = configurations[idx]
# ---------- end animate ----------

# ----
scale_3 = Scale(Geometry=path.P, Center=Point(0, 0, 0), Factor=division)  # -> Geometry, Transform

# ---- group: cartesian motion (continued)
pline = PolyLine(Vertices=scale_3.Geometry, Closed=False)

# ---- group: plan motion
# Plan free-space motion
# If you specify the tolerance vector with [360, 1, 1], it means that
#     the frame's y-axis and z-axis are allowed to rotate about the x-axis by an
#     angle of 360 degrees, whereas the x-axis can only change 1 degree.
number_slider_2 = Slider(1, range=1..360)
group_2 = Data(main_planning_group)
list_7 = ValueList({"don't use attached collision mesh": 0, "use attached collision mesh": 1}, selected="don't use attached collision mesh")
list_8 = ValueList({"current configuration": 0, "zero configuration": 1}, selected="current configuration")
python_5 = PythonScript(
    robot=robot,
    group=group_2,
    goal_plane=start_plane,
    tolerance_position=Slider(0.001, range=0..0.001),
    tolerance_xaxis_deg=number_slider_2,
    tolerance_yaxis_deg=Slider(1, range=1..360),
    tolerance_zaxis_deg=Slider(1, range=1..360))  # -> goal_constraints
# ---------- python_5: Python ----------
import math
from compas.geometry import Frame

frame = Frame(goal_plane.Origin, goal_plane.XAxis, goal_plane.YAxis)

tolerances_axes = [math.radians(tolerance_xaxis_deg), math.radians(tolerance_yaxis_deg), math.radians(tolerance_zaxis_deg)]

if robot:
    goal_constraints = robot.constraints_from_frame(frame, tolerance_position, tolerances_axes, group)
# ---------- end python_5 ----------
filter_4 = StreamFilter(Gate=list_7, Stream1=attached.acm)
filter_5 = StreamFilter(Gate=list_8, Stream0=current_configuration_2, Stream1=zero_configuration_2)
list_9 = ValueList({"RRT", "RRT*": "RRTStar", "EST", "PRM": "RPM", "PRM*": "RPMStar", "SPARS"}, selected="RRT*")

# ----
plan_motion = PythonScript(
    robot=robot,
    group=group_2,
    start_configuration=filter_5,
    goal_constraints=python_5,
    planner_id=list_9,
    attached_collision_meshes=filter_4,
    compute=compute)  # -> out, trajectory; inputs goal_constraints: list, attached_collision_meshes: list
# ---------- plan_motion: Python ----------
"""Calculates a motion path.
    Inputs:
        robot: The robot
        group: str, optional
            The planning group used for calculation. Defaults to the robot's
            main planning group.
        start_configuration: :class:`compas_fab.robots.Configuration`, optional
            The robot's full configuration, i.e. values for all configurable
            joints of the entire robot cell, at the starting position. Defaults
            to the all-zero configuration.
        goal_constraints: list of :class:`compas_fab.robots.Constraint`
            The goal to be achieved, defined in a set of constraints.
            Constraints can be very specific, for example defining value domains
            for each joint, such that the goal configuration is included,
            or defining a volume in space, to which a specific robot link (e.g.
            the end-effector) is required to move to.
        planner_id: str
            The name of the algorithm used for path planning.
            Defaults to 'RRTConnectkConfigDefault'.
        attached_collision_meshes: list of :class:`compas_fab.robots.AttachedCollisionMesh`
            Defaults to None.
        compute: bool
            Press to calculate solution.
    Output:
        :class:`compas_fab.robots.JointTrajectory`
            The calculated trajectory.
"""
from __future__ import print_function
import logging
import scriptcontext as sc

guid = str(ghenv.Component.InstanceGuid)
response_key = "response_" + guid
if response_key not in sc.sticky:
    sc.sticky[response_key] = None

print("Start Configuration:",start_configuration)

LOGGER = logging.getLogger('roslibpy')

if robot and robot.client and start_configuration and compute:
    if robot.client.is_connected:
        sc.sticky[response_key] = robot.plan_motion(goal_constraints,
                                                    start_configuration,
                                                    group,
                                                    options={
                                                        'planner_id': str(planner_id),
                                                        'attached_collision_meshes': list(attached_collision_meshes),
                                                    })
    else:
        print("Robot client is not connected.")

trajectory = sc.sticky[response_key]
# ---------- end plan_motion ----------
py_7 = PythonScript(robot=robot, group=group_2, trajectory=plan_motion.trajectory)  # -> configurations, full_configurations, fraction, time; same code as py_6
panel_22 = Panel(plan_motion.out)
animate_2 = PythonScript(robot=robot, group=group_2, configurations=py_7.full_configurations, idx=idx)  # -> configuration; inputs configurations: list, idx: Int32; same code as animate

# ----
# Execution
speed = Slider(33, range=1..950)
rosclient_for_physical_robot = Data(ros_2.ros_client)
filter_6 = StreamFilter(
    Gate=list_2,
    Stream0=forward_kinematics,
    Stream1=inverse.full_configuration,
    Stream2=plan_cartesian_motion.trajectory,
    Stream3=plan_motion.trajectory,
    Stream4=python_4.full_current_configuration)

# ---- group: SEND TEXT
python_6 = GhPythonScript(message="Hello World, this is ROB1", ros=rosclient_for_physical_robot, run=Button())  # -> out
# ---------- python_6: Python ----------
import compas_rrc as rrc
abb = rrc.AbbClient(ros, '/rob1')
print('Connected.')

if run : 
    abb.send_and_wait(rrc.PrintText(message))
# ---------- end python_6 ----------
panel_23 = Panel(python_6)

# ----
# send line instruction (with force)
button_2 = Button()
python_7 = GhPythonScript(trajectory=filter_6, ros=rosclient_for_physical_robot, speed=speed, run=button_2, plane1=start_plane, plane2=end_plane)  # -> out
# ---------- python_7: Python ----------
import compas_rrc as rrc
import math
from  compas.geometry import Frame
from  compas.geometry import Plane

abb = rrc.AbbClient(ros, '/rob1')
print('Connected.')

f1 = Frame(plane1.Origin, plane1.XAxis, plane1.YAxis)
f2 = Frame(plane2.Origin, plane2.XAxis, plane2.YAxis)

PT1_q = f1.quaternion
PT2_q = f2.quaternion

#print([speed, plane1.Origin.X*1000, plane1.Origin.Y*1000, plane1.Origin.Z*1000, PT1_q[0], PT1_q[1], PT1_q[2], PT1_q[3], plane2.Origin.X*1000, plane2.Origin.Y*1000, plane2.Origin.Z*1000, PT2_q[0], PT2_q[1], PT2_q[2], PT2_q[3]])

if run : 
    abb.send(rrc.CustomInstruction('r_RRC_CustomInstruction_FC',[], [speed, plane1.Origin.X*1000, plane1.Origin.Y*1000, plane1.Origin.Z*1000, PT1_q[0], PT1_q[1], PT1_q[2], PT1_q[3], plane2.Origin.X*1000, plane2.Origin.Y*1000, plane2.Origin.Z*1000, PT2_q[0], PT2_q[1], PT2_q[2], PT2_q[3]]))
# ---------- end python_7 ----------
panel_24 = Panel(python_7)

# ----
# send paths (joint values)
button_3 = Button()
python_8 = GhPythonScript(trajectory=filter_6, ros=rosclient_for_physical_robot, run=button_3, speed=speed)  # -> out
# ---------- python_8: Python ----------
import compas_rrc as rrc
import math
abb = rrc.AbbClient(ros, '/rob1')
print('Connected.')

#external_axes = [0,0,0,0,0,0]
external_axes = []

if run : 
    for point in trajectory.points:
        robot_joints = [math.degrees(p) for p in point.positions]
        print("robot_joints =", robot_joints)
        abb.send(rrc.MoveToJoints(robot_joints, external_axes, speed, rrc.Zone.Z1))
# ---------- end python_8 ----------
panel_25 = Panel(python_8)

# ----
# send custom instruction
button_4 = Button()
python_9 = GhPythonScript(trajectory=filter_6, ros=rosclient_for_physical_robot, speed=speed, run=button_4)  # -> out
# ---------- python_9: Python ----------
import compas_rrc as rrc
import math
abb = rrc.AbbClient(ros, '/rob1')
print('Connected.')


if run : 
    abb.send(rrc.CustomInstruction('r_RRC_CustomInstruction', ["a"], [50, speed]))
# ---------- end python_9 ----------
panel_26 = Panel(python_9)

# ---- group: plan motion (continued)
vis_2 = PythonScript(response=plan_motion.trajectory)  # -> P, V, A, time
# ---------- vis_2: Python ----------
from compas_ghpython import list_to_ghtree

if response:

    positions = []
    velocities = []
    accelerations = []
    time_from_start = []

    for p in response.points:
        positions.append(p.positions)
        velocities.append(p.velocities)
        accelerations.append(p.accelerations)
        time_from_start.append(p.time_from_start.seconds)

    P = list_to_ghtree(list(zip(*positions)))
    V = list_to_ghtree(list(zip(*velocities)))
    A = list_to_ghtree(list(zip(*accelerations)))

    time = time_from_start[-1]
    print time
# ---------- end vis_2 ----------
time_s_2 = Panel(vis_2.time)
prismatic_2 = QuickGraph(vis_2.P, SortOrder=0)
fraction_2 = Panel(py_7.fraction)
time_s_3 = Panel(py_7.time)
graph_3 = QuickGraph(vis_2.V, SortOrder=0)
graph_4 = QuickGraph(vis_2.A, SortOrder=0)
path_2 = GhPythonScript(robot=robot, group=group_2, full_configurations=py_7.full_configurations, scale_factor=units)  # -> frames, P; inputs full_configurations: list; same code as path

# ----
scale_4 = Scale(Geometry=path_2.P, Center=Point(0, 0, 0), Factor=division)  # -> Geometry, Transform

# ---- group: plan motion (continued)
pline_2 = PolyLine(Vertices=scale_4.Geometry, Closed=False)

# ----
# Visualisation
# Select configuration input: from fk, ik, path, or from real robot
filter_7 = StreamFilter(
    Gate=list_2,
    Stream0=forward_kinematics,
    Stream1=inverse.full_configuration,
    Stream2=animate,
    Stream3=animate_2,
    Stream4=item_2)
filter_8 = StreamFilter(
    Gate=list_2,
    Stream0=pln_4,
    Stream1=pln_2,
    Stream2=[scale_3.Geometry, pline],
    Stream3=[pline_2, scale_4.Geometry],
    Stream4=item)
show_end_effector_frame = BooleanToggle(False)
show_base_frame = BooleanToggle(False)
show_collision = BooleanToggle(False)
show_frames = BooleanToggle(True)
show_visual = BooleanToggle(True)
preview_2 = CustomPreview(Geometry=filter_8, Material=ColourSwatch(SwatchColor=RGB(59, 161, 95)))
visualize = PythonScript(
    robot=robot,
    group=main_planning_group,
    full_configuration=filter_7,
    show_visual=show_visual,
    show_collision=show_collision,
    show_frames=show_frames,
    show_base_frame=show_base_frame,
    show_end_effector_frame=show_end_effector_frame)  # -> out, visual, collision, frames, base_frame_WCF, ee_frame_WCF
# ---------- visualize: Python ----------
"""Calculates a cartesian motion path (linear in tool space).
    Inputs:
        robot: The robot
        group: str
            The planning group used for visualisation
        full_configuration: :class:`compas_fab.robots.Configuration`
            The robot's full configuration to display.
        show_visual: bool
           Whether or not to show the robot's visual meshes.
        show_collision: bool
           Whether or not to show the robot's collision meshes.
        show_frames: bool
           Whether or not to show the robot's joint frames.
        show_base_frame: bool
           Whether or not to show the robot's base frame.
        show_end_effector_frame: bool
            Whether or not to show the robot's end-effector frame.
    Output:
        visual: The robot's visual meshes.
        collision: The robot's collision meshes.
        frames: The robot's joint frames.
        base_frame_WCF: The robot's base frame.
        ee_frame_WCF: The robot's end-effector frame.
"""
from __future__ import print_function

if robot and full_configuration:
    robot.update(full_configuration, visual=show_visual, collision=show_collision)

    print(full_configuration)

    if show_visual:
        visual = robot.draw_visual()

    if show_collision:
        collision = robot.draw_collision()

    if show_frames:
        axes = robot.transformed_axes(full_configuration)
        frames = robot.transformed_frames(full_configuration)

    if show_base_frame:
        base_frame_WCF = robot.get_base_frame(group, full_configuration)

    if show_end_effector_frame:
        ee_frame_WCF = robot.get_end_effector_frame(group, full_configuration)
        print("End-effector", ee_frame_WCF)
# ---------- end visualize ----------
py_8 = PythonScript(robot=robot)  # -> scale
# ---------- py_8: Python ----------
if robot:
    scale = robot.scale_factor * 0.1
else:
    scale = 1.
# ---------- end py_8 ----------
geo = Geometry(visualize.collision)
geo_2 = Geometry(visualize.visual)
draw = GhPythonScript(frames=[visualize.ee_frame_WCF, visualize.base_frame_WCF, visualize.frames], scale=py_8)  # -> P, V, C, W; inputs frames: list
# ---------- draw: Python ----------
from System.Drawing import Color
from compas_ghpython import draw_frame

red = Color.FromArgb(255, 0, 0)
green = Color.FromArgb(0, 255, 0)
blue = Color.FromArgb(0, 0, 255)

P = []
V = []
C = []

scale = float(scale)

for frame in frames:
    if not frame:
        continue
    plane = draw_frame(frame)
    P += [plane.Origin] * 3
    V.append(plane.XAxis * scale)
    V.append(plane.YAxis * scale)
    V.append(plane.ZAxis * scale)
    C += [red, green, blue]

W = 3
# ---------- end draw ----------
panel_27 = Panel(visualize.out)
preview_3 = CustomPreview(Geometry=geo_2, Shader=ColourSwatch(SwatchColor=RGB(105, 105, 105)))
vdisex = VectorDisplayEx(Point=draw.P, Vector=draw.V, Colour=draw.C, Width=draw.W)

# ----
# send point (joint values)
button_5 = Button()
python_10 = GhPythonScript(configuration=filter_7, ros=rosclient_for_physical_robot, run=button_5, speed=speed)  # -> out
# ---------- python_10: Python ----------
import compas_rrc as rrc
import math
abb = rrc.AbbClient(ros, '/rob1')
print('Connected.')

#external_axes = [0,0,0,0,0,0]
external_axes = []

if run : 
    robot_joints = [math.degrees(jv) for jv in configuration.joint_values]
    print("robot_joints =", robot_joints)
    abb.send(rrc.MoveToJoints(robot_joints, external_axes, speed, rrc.Zone.Z10))
# ---------- end python_10 ----------
panel_28 = Panel(python_10)

# ---- group: READ FORCE
calibrate = Button()
read = Button()
python_11 = GhPythonScript(ros=rosclient_for_physical_robot, run=calibrate)  # -> out
# ---------- python_11: Python ----------
import compas_rrc as rrc
abb = rrc.AbbClient(ros, '/rob1')
print('Connected.')

string_values = []
float_values = []

if run : 
    # Custom instruction 
    raw_msg = abb.send(rrc.CustomInstruction("r_RRC_FCCalib", string_values, float_values))

    # Print feedback 
    print('Feedback = ', raw_msg)
# ---------- end python_11 ----------
python_12 = GhPythonScript(ros=rosclient_for_physical_robot, run=read)  # -> out
# ---------- python_12: Python ----------
import compas_rrc as rrc
abb = rrc.AbbClient(ros, '/rob1')
print('Connected.')

string_values = []
float_values = []

if run : 
    # Custom instruction 
    raw_msg = abb.send_and_wait(rrc.Debug(rrc.CustomInstruction("r_RRC_readForce", string_values, float_values)))

    # Print feedback 
    print('Feedback = ', raw_msg)
# ---------- end python_12 ----------
rec_5 = DataRecorder(python_11, DataLimit=-10, RecordData=True)
panel_29 = Panel(rec_5)

# ----
rec_6 = DataRecorder(python_12, DataLimit=-10, RecordData=True)

# ---- group: READ FORCE (continued)
panel_30 = Panel(rec_6)
