# Grasshopper definition ABB_GoFa_robot_playground_AR503_12.ghx (Grasshopper 1.0.7)

# ----
# Robot model
connect = BooleanToggle(True)
ros = ROSConnect(connect=connect)  # -> ros_client, is_connected; inputs port: Int32, connect: Boolean
#   port ip: The ip address ROS. Defaults to 127.0.0.1.
#   port port: The port of ROS. Defaults to 9090.
#   port connect: If True, connects to ROS. If False, disconnects from ROS. Defaults to False.
#   port ros_client: The ROS client.
#   port is_connected: True if connection established.
# ---------- ros: Python ----------
"""
Connect or disconnect to ROS.

COMPAS FAB v0.27.0
"""
from ghpythonlib.componentbase import executingcomponent as component
from scriptcontext import sticky as st

from compas_fab.backends import RosClient
from compas_fab.ghpython.components import create_id


class ROSConnect(component):
    def RunScript(self, ip, port, connect):
        ros_client = None

        ip = ip or '127.0.0.1'
        port = port or 9090

        key = create_id(self, 'ros_client')
        ros_client = st.get(key, None)

        if ros_client:
            st[key].close()
        if connect:
            st[key] = RosClient(ip, port)
            st[key].run(5)

        ros_client = st.get(key, None)
        is_connected = ros_client.is_connected if ros_client else False
        return (ros_client, is_connected)
# ---------- end ros ----------
load_robot = BooleanToggle(True)
robot = ROSRobot(ros_client=ros.ros_client, load=load_robot)  # -> robot; inputs load: Boolean
#   port ros_client: The ROS client.
#   port load: If True, loads the robot from ROS. Defaults to False.
# ---------- robot: Python ----------
"""
Load robot directly from ROS.

COMPAS FAB v0.27.0
"""
from compas_ghpython.artists import RobotModelArtist
from ghpythonlib.componentbase import executingcomponent as component
from scriptcontext import sticky as st

from compas_fab.ghpython.components import create_id


class ROSRobot(component):
    def RunScript(self, ros_client, load):
        key = create_id(self, 'robot')

        if ros_client and ros_client.is_connected and load:
            # Load URDF from ROS
            st[key] = ros_client.load_robot(load_geometry=True, precision='12f')
            st[key].artist = RobotModelArtist(st[key].model)

        robot = st.get(key, None)
        if robot:  # client sometimes need to be restarted, without needing to reload geometry
            robot.client = ros_client
        return robot
# ---------- end robot ----------

# ----
# Table
swatch = ColourSwatch(SwatchColor=RGB(255, 254, 254))
material = CreateMaterial(Diffuse=swatch, Specular=RGB(255, 254, 254), Emission=RGB(0, 0, 0), Transparency=0, Shine=0)
brep = Brep(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)
preview = CustomPreview(Geometry=brep, Material=material)

python = GhPythonScript()  # -> frame
# ---------- python: Python ----------
from compas_rhino.conversions import plane_to_compas_frame

frame = plane_to_compas_frame(plane)
# ---------- end python ----------
info = Info()  # -> info
#   port info: Environment info.
# ---------- info: Python ----------
"""
Displays information about the active COMPAS environment.
"""
import compas_bootstrapper
from ghpythonlib.componentbase import executingcomponent as component

import compas


class CompasInfo(component):
    def RunScript(self):
        self.Message = "COMPAS v{}".format(compas.__version__)
        info = "COMPAS Version: {}\nEnvironment: {}"
        return info.format(compas.__version__, compas_bootstrapper.ENVIRONMENT_NAME)
# ---------- end info ----------

# ---- group: HOME VERTICAL PLANE
pln = Plane(Plane(origin=(550.0007324, -0.0004259967827, 717.9949341), x=(-0.7071095686, -0.7071039938, 2.741176192e-06), y=(-0.7071039938, 0.7071095686, 2.714447101e-06)))

# ---- group: PICK PLANE
pln_2 = Plane(Plane(origin=(0.008659569547, 478.9905396, 168.5522919), x=(0.7071163696, -0.7070971821, 0.0001221992158), y=(-0.7070971926, -0.7071163622, 0.000102915822)))

# ----
# Tool
gripper_meshes = Mesh([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])
gripper_bounding_box_mesh = Mesh(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)
gripper_tcf = Plane(Plane(origin=(0.1534, 0, 0), x=(0, 0.7071067812, 0.7071067812), y=(0, -0.7071067812, 0.7071067812)))
mjoin = MeshJoin(Meshes=gripper_meshes)
tool = AttachedTool(robot=robot, visual_mesh=mjoin, collision_mesh=gripper_bounding_box_mesh, tcf_plane=gripper_tcf)  # -> robot; inputs visual_mesh: Mesh, collision_mesh: Mesh
#   port visual_mesh: A visual mesh for the tool.
#   port collision_mesh: A collision mesh for the tool.
#   port tcf_plane: The frame of the tool in tool0 frame.
#   port group: The planning group to which the tool should be attached.
# ---------- tool: Python ----------
"""
Attach a tool to the robot.

COMPAS FAB v0.27.0
"""
from ghpythonlib.componentbase import executingcomponent as component
from compas_rhino.conversions import RhinoMesh
from compas_rhino.conversions import plane_to_compas_frame

from compas.geometry import Frame
from compas_fab.robots import Tool


class AttachToolComponent(component):
    def RunScript(self, robot, visual_mesh, collision_mesh, tcf_plane, group):
        if robot and robot.client and robot.client.is_connected and visual_mesh:
            if not collision_mesh:
                collision_mesh = visual_mesh

            c_visual_mesh = RhinoMesh.from_geometry(visual_mesh).to_compas()
            c_collision_mesh = RhinoMesh.from_geometry(collision_mesh).to_compas()

            if not tcf_plane:
                frame = Frame.worldXY()
            else:
                frame = plane_to_compas_frame(tcf_plane)
            tool = Tool(c_visual_mesh, frame, c_collision_mesh)

            robot.attach_tool(tool, group)

        return robot
# ---------- end tool ----------

panel = Panel(info)
t0cf_to_tcf = T0cfToTcf(G=pln_2)
t0cf_to_tcf_2 = T0cfToTcf(G=pln)
pln_3 = Plane(t0cf_to_tcf)
pln_4 = Plane(t0cf_to_tcf_2)

# ---- group: BRICK DIMENSIONS
panel_2 = Panel(".1")
panel_3 = Panel(".05")
panel_4 = Panel("0.0265")

# ----
# Brick wall
# Brick top plane
# Points from curves
# Surface lowest point
start_and_end_offsets = Slider(0.02, range=0..0.1)
tolerance_between_bricks = Slider(0.0007, range=0..0.001)
brick_spacing = Slider(0.11, range=0.1..0.2)
input_surface = Surface(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)
surface_lowest_point = SurfaceLowestPoint(C=input_surface)
division = Division(A=panel_2, B=-4)
division_2 = Division(A=panel_3, B=2)
pt = ConstructPoint(XCoordinate=division, YCoordinate=division_2, ZCoordinate=0)
addition = Addition(A=panel_4, B=tolerance_between_bricks)
Z = UnitZ(Factor=1)
domain_box = DomainBox(Base=pt, X=panel_2, Y=panel_3, Z=panel_4)
contour = Contour(Shape=input_surface, Point=surface_lowest_point, Direction=Z, Distance=addition)  # -> flatten(Contours)
cluster = Cluster_2(B=domain_box)
cluster_2 = Cluster_3(num=start_and_end_offsets, L=contour, A=brick_spacing)
brick_height = Number(panel_4)
Z_2 = UnitZ(Factor=brick_height)
move = Move(Geometry=cluster_2, Motion=Z_2)  # -> Geometry, Transform
pflip = FlipPlane(Plane=move.Geometry, ReverseX=False, ReverseY=False, SwapAxes=True)
prot = RotatePlane(Plane=pflip, Angle=degrees("180"))
pln_5 = Plane(flatten(prot))
orient = Orient(Geometry=domain_box, Source=cluster, Target=flatten(pln_5))  # -> flatten(Geometry), Transform

jp = GhPythonScript()  # -> packing_joint_values
# ---------- jp: Python ----------
import math
packing_joint_values = [0, 0, 85, 0, 0, 0]
print packing_joint_values
# ---------- end jp ----------
jp_2 = GhPythonScript()  # -> home_vertical_joint_values
# ---------- jp_2: Python ----------
import math
home_vertical_joint_values = [0, 0, 0, 0, 90, -45]
print home_vertical_joint_values
# ---------- end jp_2 ----------

# ---- group: forward kinematics
# Forward Kinematics: set the rotation of each joint manually
a4 = Slider(0, range=-360..360)
a1 = Slider(0, range=-180..180)
a2 = Slider(0, range=-360..360)
a3 = Slider(0, range=-360..360)
a5 = Slider(90, range=-360..360)
a6 = Slider(-45, range=-360..360)
jp_3 = GhPythonScript()  # -> all_joint_value_zero
# ---------- jp_3: Python ----------
import math
all_joint_value_zero = [0] * 6
print all_joint_value_zero
# ---------- end jp_3 ----------
load_presets = Button()
forward_kinematics = PythonScript(robot=tool, set_joint_positions=load_presets, joint_positions=jp_2, a1=a1, a2=a2, a3=a3, a4=a4, a5=a5, a6=a6)  # -> full_configuration; inputs joint_positions: list
# ---------- forward_kinematics: Python ----------
import math
import Grasshopper
from compas.robots import Joint
from compas_fab.robots import Configuration

if set_joint_positions:

    j = 0
    for i in range(ghenv.Component.Params.Input.Count):
        nslider = ghenv.Component.Params.Input[i].Sources[0]
        if nslider.GetType() == Grasshopper.Kernel.Special.GH_NumberSlider:
            nslider.TrySetSliderValue(joint_positions[j])
            j += 1

if robot:
    joint_positions = [a1, a2, a3, a4, a5, a6]
    joint_types = robot.get_configurable_joint_types()
    for i, joint_type in enumerate(joint_types):
        if joint_type == Joint.REVOLUTE:
            joint_positions[i] = math.radians(joint_positions[i])
    full_configuration = Configuration(joint_positions, joint_types)
# ---------- end forward_kinematics ----------

# ---- group: Simulation from MoveIt / target point
point = Point(<point referenced from the Rhino model>)

# ---- group: OFFSET PLANES FOR PICKING
picking_placing_height_on_brick = Slider(0.008, range=0..0.01)
Z_3 = UnitZ(Factor=picking_placing_height_on_brick)
rev = Reverse(Vector=Z_3)
move_2 = Move(Geometry=pln_5, Motion=rev)  # -> Geometry, Transform

# ----
list = ValueList({"Forward Kinematics": 0, "Inverse Kinematics": 1}, selected="Inverse Kinematics")
pick_plane = Plane(pln_3)
Z_4 = UnitZ(Factor=Slider(0.05, range=0..0.1))
path = ConstructPath(Indices=list)
move_3 = Move(Geometry=pick_plane, Motion=Z_4)  # -> Geometry, Transform
pick_approach_plane = Plane(move_3.Geometry)
number_slider = Slider(100, range=0..300)
merge = Merge(Data1=pick_approach_plane, Data2=pick_plane)
ros_client = Data(ros.ros_client)
all_place_planes = Plane(move_2.Geometry)

# ----
# send plane
button = Button()
tcf_to_t0cf = TcfToT0cf(G=merge)
python_2 = GhPythonScript(planes=tcf_to_t0cf, ros=ros_client, run=button, speed=number_slider)  # inputs planes: list
# ---------- python_2: Python ----------
from compas_rhino.conversions import RhinoPlane
import compas_rrc as rrc
abb = rrc.AbbClient(ros, '/rob1')
print('Connected.')

frames = []

if run : 

    for plane in planes :
        frames.append(RhinoPlane.from_geometry(plane).to_compas_frame())
    
    # Set tool
    abb.send(rrc.SetTool('tool0'))

    # Set work object
    abb.send(rrc.SetWorkObject('wobj0'))
    
    for frame in frames: 
        abb.send_and_wait(rrc.MoveToFrame(frame, speed, rrc.Zone.FINE, rrc.Motion.LINEAR), timeout = 10)
# ---------- end python_2 ----------

# ----
# send text to flexpendant
button_2 = Button()
python_3 = GhPythonScript(message="Salut les Hoffmann, ici Raph !", ros=ros_client, run=button_2)
# ---------- python_3: Python ----------
import compas_rrc as rrc
abb = rrc.AbbClient(ros, '/rob1')
print('Connected.')

if run : 
    abb.send_and_wait(rrc.PrintText(message), timeout = 10)
# ---------- end python_3 ----------

# ----
# get frame and joint values
button_3 = Button()
python_4 = GhPythonScript(ros=ros_client, run=button_3)  # -> frame, joints
# ---------- python_4: Python ----------
import compas_rrc as rrc
abb = rrc.AbbClient(ros, '/rob1')
print('Connected.')

if run : 

    # Set tool
    abb.send(rrc.SetTool('tool0'))
    
    # Set work object
    abb.send(rrc.SetWorkObject('wobj0'))
    
    # Read current frame position
    frame = abb.send_and_wait(rrc.GetFrame(), timeout = 10)
    print("frame: ", frame)
    
    # Read current Configuration
    joints = abb.send_and_wait(rrc.GetJoints(), timeout = 10)
    print("joints: ", joints)
# ---------- end python_4 ----------
cluster_3 = Cluster(rec=python_4.frame, rec_2=python_4.joints)  # -> plane, configuration_2

# ----
# gripping
open = Button()
close = Button()
python_5 = GhPythonScript(ros=ros_client, open=open, close=close)  # inputs open: Boolean
# ---------- python_5: Python ----------
import compas_rrc as rrc
abb = rrc.AbbClient(ros, '/rob1')
print('Connected.')

if open : 
    abb.send(rrc.SetDigital('ABB_Scalable_IO_0_DO16', 1))
    
if close : 
    abb.send(rrc.SetDigital('ABB_Scalable_IO_0_DO16', 0))
# ---------- end python_5 ----------

panel_5 = Panel(cluster_3.plane)
panel_6 = Panel(cluster_3.configuration_2)
bricks_geometries = Brep(orient.Geometry)

# ----
# Inputs
tolerance_deg = Slider(1, range=0..10)

approach_vector = GhPythonScript()  # -> out, vector
# ---------- approach_vector: Python ----------
from compas.geometry import Vector
vector = Vector(0, 0, .05)
# ---------- end approach_vector ----------

# ---- group: Simulation from MoveIt
# Inverse Kinematics: the server solves for the robotic pose
#  to reach a given target
xy_plane = XYPlane(Origin=point)
zero_config = ZeroConfig(robot=tool)  # -> config
#   port group: If assigned, it will return the zero configuration for the given group, otherwise a full zero configuration.
#   port config: The zero configuration.
# ---------- zero_config: Python ----------
"""
Get a zero configuration for a robot.

COMPAS FAB v0.27.0
"""
from ghpythonlib.componentbase import executingcomponent as component


class ConfigZero(component):
    def RunScript(self, robot, group):

        if robot:
            return robot.zero_configuration(group)

        return None
# ---------- end zero_config ----------
flip_plane = FlipPlane(Plane=xy_plane, ReverseX=True, ReverseY=False, SwapAxes=False)

# ----
# send joint values
button_4 = Button()

# ----
# Pick n’ Place
all_place_planes_2 = Plane(all_place_planes)
run = Button()
home_vertical = Plane(pln_4)
pick_approach = Plane(pick_approach_plane)
pick_plane_2 = Plane(pick_plane)

# ---- group: MANUAL COUNTER
rec = DataRecorder(run, DataLimit=-10, RecordData=True)
int = Integer(0)
ma = MassAddition(Input=[rec, int])  # -> Result, PartialResults
dam = DataDam(DataA=ma.Result, BufferDelay=20000000, BufferMode=2)

# ----
brick_index = Panel(dam)
item = ListItem(List=flatten(all_place_planes_2), Index=brick_index, Wrap=True)
transform = Transform(Geometry=item, Transform=move_3.Transform)
place_approach = Plane(transform)

split = SplitList(List=bricks_geometries, Index=expr("x+1", brick_index))  # -> ListA, ListB
place_plane = Plane(item)

# ---- group: Simulation from MoveIt (continued)
ik = InverseKinematics(robot=tool, plane=place_plane, start_configuration=zero_config)  # -> configuration
#   port plane: The plane or frame to calculate the inverse kinematic for.
#   port start_configuration: If passed, calculates the inverse such that the joint positions differ the least from the start_configuration. Defaults to the zero configuration.
#   port group: The planning group used for calculation. Defaults to the robot's main planning group.
#   port configuration: The planning group's configuration.
# ---------- ik: Python ----------
"""
Calculate the robot's inverse kinematic for a given plane.

COMPAS FAB v0.27.0
"""
from compas_rhino.conversions import RhinoPlane
from ghpythonlib.componentbase import executingcomponent as component


class InverseKinematics(component):
    def RunScript(self, robot, plane, start_configuration, group):
        configuration = None
        if robot and robot.client and robot.client.is_connected and plane:
            frame = RhinoPlane.from_geometry(plane).to_compas_frame()
            configuration = robot.inverse_kinematics(frame, start_configuration, group)
        return configuration
# ---------- end ik ----------

# ----
entwine = Entwine(Branch00=forward_kinematics, Branch01=ik, FlattenInputs=True)  # -> simplify(Result)
branch = TreeBranch(Tree=entwine, Path=path, MaintainPaths=True)
robot_visualize = RobotVisualize(robot=tool, configuration=branch)  # -> visual, collision, collision_meshes, attached_meshes, frames, base_frame, ee_frame; inputs show_visual: Boolean, show_collision: Boolean, show_frames: Boolean, show_base_frame: Boolean, show_end_effector_frame: Boolean, show_cm: Boolean, show_acm: Boolean
#   port group: The planning group used for end-effector and base visualization.
#   port configuration: The robot's full configuration.
#   port show_visual: Whether or not to show the robot's visual meshes.
#   port show_collision: Whether or not to show the robot's collision meshes.
#   port show_frames: Whether or not to show the robot's joint frames.
#   port show_base_frame: Whether or not to show the robot's base frame.
#   port show_end_effector_frame: Whether or not to show the robot's end-effector frame.
#   port show_cm: Whether or not to show the collision meshes (if any).
#   port show_acm: Whether or not to show the attached collision meshes (if any).
#   port visual: Rhino meshes of the robot's visual geometry (if any).
#   port collision: Rhino meshes of the robot's collision geometry (if any).
#   port collision_meshes: Rhino meshes of the scene's collision meshes (if any).
#   port attached_meshes: Rhino meshes of the scene's attached collision meshes (if any).
#   port frames: The robot's joint frames as Rhino planes (if any).
#   port base_frame: The robot's base frame as a Rhino plane (if any).
#   port ee_frame: The robot's end-effector frame as a Rhino plane (if any).
# ---------- robot_visualize: Python ----------
"""
Visualizes the robot.

COMPAS FAB v0.27.0
"""
from compas.artists import Artist
from compas.geometry import Frame
from compas.geometry import Transformation
from compas_fab.robots import PlanningScene
from ghpythonlib.componentbase import executingcomponent as component


class RobotVisualize(component):
    def RunScript(
        self,
        robot,
        group,
        configuration,
        show_visual,
        show_collision,
        show_frames,
        show_base_frame,
        show_end_effector_frame,
        show_cm,
        show_acm,
    ):

        visual = None
        collision = None
        collision_meshes = None
        attached_meshes = None
        frames = None
        base_frame = None
        ee_frame = None

        if robot:
            show_visual = True if show_visual is None else show_visual
            show_cm = True if show_cm is None else show_cm
            show_acm = True if show_acm is None else show_acm
            configuration = configuration or robot.zero_configuration()

            robot.update(configuration, visual=show_visual, collision=show_collision)
            compas_frames = robot.transformed_frames(configuration, group)

            if show_visual:
                visual = robot.artist.draw_visual()

            if show_collision:
                collision = robot.artist.draw_collision()

            if show_base_frame:
                base_compas_frame = compas_frames[0]
                artist = Artist(base_compas_frame)
                base_frame = artist.draw()

            if show_end_effector_frame:
                ee_compas_frame = robot.forward_kinematics(
                    configuration, group, options=dict(solver="model")
                )
                artist = Artist(ee_compas_frame)
                ee_frame = artist.draw()

            if show_frames:
                frames = []
                for compas_frame in compas_frames[1:]:
                    artist = Artist(compas_frame)
                    frame = artist.draw()
                    frames.append(frame)

            if show_cm or show_acm:
                scene = PlanningScene(robot)
                scene = robot.client.get_planning_scene()

                collision_meshes = []
                attached_meshes = []

                if show_cm:
                    for co in scene.world.collision_objects:
                        header = co.header
                        frame_id = header.frame_id
                        cms = co.to_collision_meshes()

                        for cm in cms:
                            if cm.frame != Frame.worldXY():
                                t = Transformation.from_frame(cm.frame)
                                mesh = cm.mesh.transformed(t)
                            else:
                                mesh = cm.mesh

                            collision_meshes.append(Artist(mesh).draw())

                if show_acm:
                    for aco in scene.robot_state.attached_collision_objects:
                        for acm in aco.to_attached_collision_meshes():
                            frame_id = aco.object["header"]["frame_id"]
                            frame = robot.forward_kinematics(
                                configuration, options=dict(link=frame_id)
                            )
                            t = Transformation.from_frame(frame)

                            # Local CM frame
                            if (
                                acm.collision_mesh.frame
                                and acm.collision_mesh.frame != Frame.worldXY()
                            ):
                                t = t * Transformation.from_frame(
                                    acm.collision_mesh.frame
                                )

                            mesh = acm.collision_mesh.mesh.transformed(t)

                            attached_meshes.append(Artist(mesh).draw())

        return (
            visual,
            collision,
            collision_meshes,
            attached_meshes,
            frames,
            base_frame,
            ee_frame,
        )
# ---------- end robot_visualize ----------

python_6 = GhPythonScript(configuration=branch, ros=ros_client, run=button_4, speed=number_slider)
# ---------- python_6: Python ----------
import compas_rrc as rrc
import math
abb = rrc.AbbClient(ros, '/rob1')
print('Connected.')

#external_axes = [0,0,0,0,0,0]
external_axes = []

if run : 
    robot_joints = [math.degrees(jv) for jv in configuration.joint_values]
    print("robot_joints =", robot_joints)
    abb.send_and_wait(rrc.MoveToJoints(robot_joints, external_axes, speed, rrc.Zone.Z10), timeout = 10)
# ---------- end python_6 ----------

brep_2 = Brep(split.ListA)

# ---- group: PICK ORDER
merge_2 = Merge(Data1=place_approach, Data2=home_vertical, Data3=pick_approach, Data4=pick_plane_2)

# ---- group: PLACE ORDER
merge_3 = Merge(Data1=pick_approach, Data2=home_vertical, Data3=place_approach, Data4=place_plane)

# ----
tcf_to_t0cf_2 = TcfToT0cf(G=merge_2)
tcf_to_t0cf_3 = TcfToT0cf(G=merge_3)
python_7 = GhPythonScript(planes_pick=tcf_to_t0cf_2, planes_place=tcf_to_t0cf_3, ros=ros_client, run=run, speed=number_slider)  # inputs planes_pick: list, planes_place: list
# ---------- python_7: Python ----------
from compas_rhino.conversions import RhinoPlane
import compas_rrc as rrc
import time

abb = rrc.AbbClient(ros, '/rob1')
print('Connected.')

frames_pick = []
frames_place = []


if run : 

    # Set tool
    abb.send(rrc.SetTool('tool0'))

    # Set work object
    abb.send(rrc.SetWorkObject('wobj0'))
    

    #close gripper
    abb.send(rrc.SetDigital('ABB_Scalable_IO_0_DO16', 0))
    abb.send_and_wait(rrc.WaitTime(1))
    
    for plane_place in planes_place :
        frames_place.append(RhinoPlane.from_geometry(plane_place).to_compas_frame())
    
    for frame_place in frames_place: 
        abb.send_and_wait(rrc.MoveToFrame(frame_place, speed, rrc.Zone.FINE, rrc.Motion.LINEAR), timeout = 45)
    
    #open gripper
    abb.send(rrc.SetDigital('ABB_Scalable_IO_0_DO16', 1))
    
    for plane_pick in planes_pick :
        frames_pick.append(RhinoPlane.from_geometry(plane_pick).to_compas_frame())
    
    for frame_pick in frames_pick: 
        abb.send_and_wait(rrc.MoveToFrame(frame_pick, speed, rrc.Zone.FINE, rrc.Motion.LINEAR), timeout = 45)
# ---------- end python_7 ----------

robot_2 = Data(tool)
pic = Point(Point(555.7245114, -90.66801086, 88.05020889))
pt_2 = Point(Point(402.0112129, 124.9922568, 172.1572585))
xy = XYPlane(Origin=pt_2)
xy_2 = XYPlane(Origin=pic)
zero_config_2 = ZeroConfig(robot=robot_2)  # -> config; same code as zero_config
place_frame = GhPythonScript(plane=xy)  # -> frame
# ---------- place_frame: Python ----------
__author__ = "grangeot"

from compas.geometry import Frame

frame = Frame(plane.Origin, plane.XAxis, plane.YAxis)
# ---------- end place_frame ----------
pick_frame = GhPythonScript(plane=xy_2)  # -> frame; same code as place_frame
number_slider_2 = Slider(10, range=0..10)
list_2 = ValueList({"start config": 0, "approach pick config": 1, "pick config": 2, "approach place config": 3, "place config": 4, "pick path": 5, "place path": 6, "free space path": 7, "start path": 8, "full path": 9}, selected="full path")

# ----
# Pick
python_8 = GhPythonScript(pick_frame=pick_frame, approach_vector=approach_vector.vector)  # -> approach_pick_frame
# ---------- python_8: Python ----------
from compas.geometry import Translation

approach_pick_frame = pick_frame.transformed(Translation.from_vector(approach_vector))
# ---------- end python_8 ----------
ik_2 = InverseKinematics(robot=robot_2, plane=python_8, start_configuration=zero_config_2)  # -> configuration; same code as ik
ik_3 = InverseKinematics(robot=robot_2, plane=pick_frame, start_configuration=ik_2)  # -> configuration; same code as ik

# ----
# Place
python_9 = GhPythonScript(place_frame=place_frame, approach_vector=approach_vector.vector)  # -> approach_place_frame
# ---------- python_9: Python ----------
from compas.geometry import Translation

approach_place_frame = place_frame.transformed(Translation.from_vector(approach_vector))
# ---------- end python_9 ----------
ik_4 = InverseKinematics(robot=robot_2, plane=python_9, start_configuration=ik_2)  # -> configuration; same code as ik
ik_5 = InverseKinematics(robot=robot_2, plane=place_frame, start_configuration=ik_4)  # -> configuration; same code as ik

ik_6 = InverseKinematics(robot=robot_2, plane=python_9, start_configuration=ik_2)  # -> configuration; same code as ik

# ----
# Free space path - between pick and place
constraint_from_config = GhPythonScript(robot=robot_2, config=ik_4, tolerance_joint=tolerance_deg)  # -> constraints
# ---------- constraint_from_config: Python ----------
import math

if robot and config:
    TOLERANCE_JOINTS = [math.radians(tolerance_joint)] * len(robot.get_configurable_joints())
    constraints = robot.constraints_from_configuration(config, 
                                                       tolerances_above=TOLERANCE_JOINTS,
                                                       tolerances_below=TOLERANCE_JOINTS)
# ---------- end constraint_from_config ----------
plan_motion = PlanMotion(robot=robot_2, goal_constraints=constraint_from_config, start_configuration=ik_2, compute=Button())  # -> trajectory; inputs goal_constraints: list, attached_collision_meshes: list, path_constraints: list, compute: Boolean
#   port goal_constraints: The goal to be achieved, defined in a set of constraints. Constraints can be very specific, for example defining value domains for each joint, such that the goal configuration is included, or defining a volume in space, to which a specific robot link (e.g. the end-effector) is required to move to.
#   port start_configuration: The robot's full configuration, i.e. values for all configurable joints of the entire robot, at the starting position. Defaults to the all-zero configuration.
#   port group: The planning group used for calculation. Defaults to the robot's main planning group.
#   port attached_collision_meshes: A list of attached collision meshes to be included for planning.
#   port path_constraints: Optional constraints that can be imposed along the solution path. Note that path calculation won't work if the start_configuration violates these constraints. Defaults to None.
#   port planner_id: The name of the algorithm used for path planning. Defaults to 'RRTConnectkConfigDefault'
#   port compute: If True, calculates a trajectory.
#   port trajectory: The calculated trajectory.
# ---------- plan_motion: Python ----------
"""
Calculate a motion path.

COMPAS FAB v0.22.0
"""
from ghpythonlib.componentbase import executingcomponent as component
from scriptcontext import sticky as st

from compas_fab.ghpython.components import create_id


class PlanMotion(component):
    def RunScript(self, robot, goal_constraints, start_configuration, group, attached_collision_meshes, path_constraints, planner_id, compute):

        key = create_id(self, 'trajectory')

        path_constraints = list(path_constraints) if path_constraints else None
        attached_collision_meshes = list(attached_collision_meshes) if attached_collision_meshes else None
        planner_id = str(planner_id) if planner_id else 'RRTConnectkConfigDefault'

        if robot and robot.client and robot.client.is_connected and start_configuration and goal_constraints and compute:
            st[key] = robot.plan_motion(goal_constraints,
                                        start_configuration=start_configuration,
                                        group=group,
                                        options=dict(
                                            attached_collision_meshes=attached_collision_meshes,
                                            path_constraints=path_constraints,
                                            planner_id=planner_id,
                                        ))

        trajectory = st.get(key, None)
        return trajectory
# ---------- end plan_motion ----------
trajectory_visualize = TrajectoryVisualize(robot=robot_2, trajectory=plan_motion)  # -> start_configuration, configurations, fraction, time, planes, P, V, A
#   port group: The planning group for which this trajectory was planned.
#   port trajectory: The calculated trajectory.
#   port start_configuration: The start configuration of the trajectory.
#   port configurations: The full configurations along the trajectory.
#   port fraction: Indicates the fraction of requested trajectory that was calculated, e.g. 1 means the full trajectory was found.
#   port time: The time which is needed to execute that trajectory at full speed.
#   port planes: The planes of the robot's end-effector.
#   port P: The positions along the trajectory
#   port V: The velocities along the trajectory
#   port A: The accelerations along the trajectory
# ---------- trajectory_visualize: Python ----------
"""
Visualizes a trajectory.

COMPAS FAB v0.22.0
"""
from compas_ghpython import draw_frame
from compas_ghpython import list_to_ghtree
from ghpythonlib.componentbase import executingcomponent as component


class TrajectoryVisualize(component):
    def RunScript(self, robot, group, trajectory):
        start_configuration = None
        configurations = []
        fraction = 0.
        time = 0.

        planes = []
        positions = []
        velocities = []
        accelerations = []

        if robot and trajectory:
            group = group or robot.main_group_name

            for c in trajectory.points:
                configurations.append(robot.merge_group_with_full_configuration(c, trajectory.start_configuration, group))
                frame = robot.forward_kinematics(c, group, options=dict(solver='model'))
                planes.append(draw_frame(frame))
                positions.append(c.positions)
                velocities.append(c.velocities)
                accelerations.append(c.accelerations)

            start_configuration = trajectory.start_configuration
            fraction = trajectory.fraction
            time = trajectory.time_from_start

        P = list_to_ghtree(list(zip(*positions)))
        V = list_to_ghtree(list(zip(*velocities)))
        A = list_to_ghtree(list(zip(*accelerations)))

        # return outputs if you have them; here I try it for you:
        return (start_configuration, configurations, fraction, time, planes, P, V, A)
# ---------- end trajectory_visualize ----------
item_2 = ListItem(List=trajectory_visualize.configurations, Index=Slider(0, range=0..100), Wrap=True)

# ----
# Place path
merge_4 = Merge(Data1=python_9, Data2=place_frame, Data3=python_9)
plan_cartesian_motion = PlanCartesianMotion(robot=robot_2, planes=merge_4, start_configuration=ik_4, max_step=number_slider_2, compute=Button())  # -> trajectory; inputs planes: list, attached_collision_meshes: list, path_constraints: list, compute: Boolean
#   port planes: The planes or frames through which the path is defined.
#   port start_configuration: The robot's full configuration, i.e. values for all configurable joints of the entire robot, at the starting position. Defaults to the all-zero configuration.
#   port group: The planning group used for calculation. Defaults to the robot's main planning group.
#   port attached_collision_meshes: A list of attached collision meshes to be included for planning.
#   port path_constraints: Optional constraints that can be imposed along the solution path. Note that path calculation won't work if the start_configuration violates these constraints. Defaults to None.
#   port max_step: The approximate distance between the calculated points. (Defined in the robot's units.) Defaults to 0.01.
#   port compute: If True, calculates a trajectory.
#   port trajectory: The calculated trajectory.
# ---------- plan_cartesian_motion: Python ----------
"""
Calculate a cartesian motion path (linear in tool space).

COMPAS FAB v0.27.0
"""
from compas_rhino.conversions import RhinoPlane
from ghpythonlib.componentbase import executingcomponent as component
from scriptcontext import sticky as st

from compas_fab.ghpython.components import create_id


class PlanCartesianMotion(component):
    def RunScript(self, robot, planes, start_configuration, group, attached_collision_meshes, path_constraints, max_step, compute):

        key = create_id(self, 'trajectory')

        max_step = float(max_step) if max_step else 0.01
        path_constraints = list(path_constraints) if path_constraints else None
        attached_collision_meshes = list(attached_collision_meshes) if attached_collision_meshes else None

        if robot and robot.client and robot.client.is_connected and start_configuration and planes and compute:
            frames = [RhinoPlane.from_geometry(plane).to_compas_frame() for plane in planes]
            st[key] = robot.plan_cartesian_motion(frames,
                                                  start_configuration=start_configuration,
                                                  group=group,
                                                  options=dict(
                                                      max_step=max_step,
                                                      path_constraints=path_constraints,
                                                      attached_collision_meshes=attached_collision_meshes
                                                  ))

        trajectory = st.get(key, None)
        return trajectory
# ---------- end plan_cartesian_motion ----------
trajectory_visualize_2 = TrajectoryVisualize(robot=robot_2, trajectory=plan_cartesian_motion)  # -> start_configuration, configurations, fraction, time, planes, P, V, A; same code as trajectory_visualize
item_3 = ListItem(List=trajectory_visualize_2.configurations, Index=Slider(0, range=0..100), Wrap=True)

# ----
# Start path
constraint_from_config_2 = GhPythonScript(robot=robot_2, config=ik_2, tolerance_joint=tolerance_deg)  # -> constraints; same code as constraint_from_config
plan_motion_2 = PlanMotion(robot=robot_2, goal_constraints=constraint_from_config_2, start_configuration=zero_config_2, compute=Button())  # -> trajectory; inputs goal_constraints: list, attached_collision_meshes: list, path_constraints: list, compute: Boolean; same code as plan_motion
trajectory_visualize_3 = TrajectoryVisualize(robot=robot_2, trajectory=plan_motion_2)  # -> start_configuration, configurations, fraction, time, planes, P, V, A; same code as trajectory_visualize
item_4 = ListItem(List=trajectory_visualize_3.configurations, Index=Slider(0, range=0..100), Wrap=True)

# ----
# Pick path
merge_5 = Merge(Data1=python_8, Data2=pick_frame, Data3=python_8)
plan_cartesian_motion_2 = PlanCartesianMotion(robot=robot_2, planes=merge_5, start_configuration=ik_2, max_step=number_slider_2, compute=Button())  # -> trajectory; inputs planes: list, attached_collision_meshes: list, path_constraints: list, compute: Boolean; same code as plan_cartesian_motion

# ---- group: Merging all paths in correct sequence
merge_paths = GhPythonScript(
    start_trajectory=plan_motion_2,
    pick_trajectory=plan_cartesian_motion_2,
    freespace_trajectory=plan_motion,
    place_trajectory=plan_cartesian_motion)  # -> configurations
# ---------- merge_paths: Python ----------
configurations = start_trajectory.points + \
                 pick_trajectory.points + \
                 freespace_trajectory.points + \
                 place_trajectory.points
# ---------- end merge_paths ----------
item_5 = ListItem(List=merge_paths, Index=Slider(0, range=0..48), Wrap=True)

# ----
trajectory_visualize_4 = TrajectoryVisualize(robot=robot_2, trajectory=plan_cartesian_motion_2)  # -> start_configuration, configurations, fraction, time, planes, P, V, A
#   port group: The planning group for which this trajectory was planned.
#   port trajectory: The calculated trajectory.
#   port start_configuration: The start configuration of the trajectory.
#   port configurations: The full configurations along the trajectory.
#   port fraction: Indicates the fraction of requested trajectory that was calculated, e.g. 1 means the full trajectory was found.
#   port time: The time which is needed to execute that trajectory at full speed.
#   port planes: The planes of the robot's end-effector.
#   port P: The positions along the trajectory
#   port V: The velocities along the trajectory
#   port A: The accelerations along the trajectory
# ---------- trajectory_visualize_4: Python ----------
"""
Visualizes a trajectory.

COMPAS FAB v0.27.0
"""
from compas_ghpython import draw_frame
from compas_ghpython import list_to_ghtree
from ghpythonlib.componentbase import executingcomponent as component


class TrajectoryVisualize(component):
    def RunScript(self, robot, group, trajectory):
        start_configuration = None
        configurations = []
        fraction = 0.
        time = 0.

        planes = []
        positions = []
        velocities = []
        accelerations = []

        if robot and trajectory:
            group = group or robot.main_group_name

            for c in trajectory.points:
                configurations.append(robot.merge_group_with_full_configuration(c, trajectory.start_configuration, group))
                frame = robot.forward_kinematics(c, group, options=dict(solver='model'))
                planes.append(draw_frame(frame))
                positions.append(c.positions)
                velocities.append(c.velocities)
                accelerations.append(c.accelerations)

            start_configuration = trajectory.start_configuration
            fraction = trajectory.fraction
            time = trajectory.time_from_start

        P = list_to_ghtree(list(zip(*positions)))
        V = list_to_ghtree(list(zip(*velocities)))
        A = list_to_ghtree(list(zip(*accelerations)))

        # return outputs if you have them; here I try it for you:
        return (start_configuration, configurations, fraction, time, planes, P, V, A)
# ---------- end trajectory_visualize_4 ----------

item_6 = ListItem(List=trajectory_visualize_4.configurations, Index=Slider(25, range=0..100), Wrap=True)

filter = StreamFilter(
    Gate=list_2,
    Stream0=zero_config_2,
    Stream1=ik_2,
    Stream2=ik_3,
    Stream3=ik_4,
    Stream4=ik_5,
    Stream5=item_6,
    Stream6=item_3,
    Stream7=item_2,
    Stream8=item_4,
    Stream9=item_5)

# ==== cluster T0cfToTcf
G = ClusterInput()
scale = Scale(Geometry=G, Center=Point(0, 0, 0), Factor="0.001")  # -> Geometry, Transform
rotate = Rotate(Geometry=scale.Geometry, Angle=degrees("45"), Plane=scale.Geometry)  # -> Geometry, Transform
deplane = DeconstructPlane(Plane=rotate.Geometry)  # -> Origin, XAxis, YAxis, ZAxis
amp = Amplitude(Vector=deplane.ZAxis, Amplitude="0.1534")
move = Move(Geometry=rotate.Geometry, Motion=amp)  # -> Geometry, Transform
G_2 = ClusterOutput(move.Geometry)

# ==== cluster TcfToT0cf
G = ClusterInput()
rotate = Rotate(Geometry=G, Angle=degrees("-45"), Plane=G)  # -> Geometry, Transform
deplane = DeconstructPlane(Plane=rotate.Geometry)  # -> Origin, XAxis, YAxis, ZAxis
rev = Reverse(Vector=deplane.ZAxis)
amp = Amplitude(Vector=rev, Amplitude="0.1534")
move = Move(Geometry=rotate.Geometry, Motion=amp)  # -> Geometry, Transform
scale = Scale(Geometry=move.Geometry, Center=Point(0, 0, 0), Factor="1000")  # -> Geometry, Transform
G_2 = ClusterOutput(scale.Geometry)

# ==== cluster Cluster
rec = ClusterInput()
rec_2 = ClusterInput()
rec_3 = DataRecorder(rec, DataLimit=-10, RecordData=True)
rec_4 = DataRecorder(simplify(flatten(rec_2)), DataLimit=-10, RecordData=True)
clean = CleanTree(RemoveNulls=True, RemoveInvalid=True, RemoveEmpty=False, Tree=flatten(rec_4))
clean_2 = CleanTree(RemoveNulls=True, RemoveInvalid=True, RemoveEmpty=False, Tree=rec_3)
item = ListItem(List=clean, Index="-1", Wrap=True)
item_2 = ListItem(List=clean_2, Index="-1", Wrap=True)
configuration = Data(item)
draw = Draw(cg=item_2)  # -> rg
#   port cg: The COMPAS geometry or datastructure to be drawn.
#   port rg: The Rhino geometry object.
# ---------- draw: Python ----------
"""
Draws COMPAS geometry in Grasshopper.
"""
from ghpythonlib.componentbase import executingcomponent as component

from compas.artists import Artist


class CompasToRhinoGeometry(component):
    def RunScript(self, cg):
        if not cg:
            return None

        return Artist(cg).draw()
# ---------- end draw ----------
python = GhPythonScript(frame=item_2)  # -> out, plane
# ---------- python: Python ----------
import compas_rhino.conversions
import compas.artists
import compas_ghpython as cp

plane = cp.draw_frame(frame)
# ---------- end python ----------
configuration_2 = ClusterOutput(configuration)
plane = ClusterOutput(draw)

# ==== cluster SurfaceLowestPoint
C = ClusterInput()

# ---- group: SURFACE LOWEST POINT
bbox = BoundingBox(Content=C, Plane=PlaneXY(0, 0, 0))  # -> Box, Box_2
boxprop = BoxProperties(Box=bbox.Box)  # -> Center, Diagonal, Area, Volume, Degeneracy
pdecon = Deconstruct(Point=boxprop.Diagonal)  # -> XComponent, YComponent, ZComponent
pdecon_2 = Deconstruct(Point=boxprop.Center)  # -> XComponent, YComponent, ZComponent
division = Division(A=pdecon.ZComponent, B="2")
subtraction = Subtraction(A=pdecon_2.ZComponent, B=division)
pt = ConstructPoint(XCoordinate=pdecon_2.XComponent, YCoordinate=pdecon_2.YComponent, ZCoordinate=subtraction)

# ----
pt_2 = ClusterOutput(pt)

# ==== cluster Cluster_2
B = ClusterInput()
debrep = DeconstructBrep(Brep=B)  # -> Faces, Edges, Vertices
item = ListItem(List=debrep.Faces, Index="5", Wrap=True)
area = Area(Geometry=item)  # -> Area, Centroid
xy = XYPlane(Origin=area.Centroid)
pflip = FlipPlane(Plane=xy, ReverseX=False, ReverseY=False, SwapAxes=True)
P = ClusterOutput(pflip)

# ==== cluster Cluster_3
L = ClusterInput()
dispatch = Dispatch(List=L, DispatchPattern=[True, False])  # -> ListA, ListB
curve = Curve(dispatch.ListA)
curve_2 = Curve(dispatch.ListB)
item = ListItem(List=curve_2, Index=0, Wrap=True)
item_2 = ListItem(List=curve, Index=0, Wrap=True)
flip = FlipCurve(Curve=curve_2, Guide=item)  # -> Curve, Flag
flip_2 = FlipCurve(Curve=curve, Guide=item_2)  # -> Curve, Flag
A = ClusterInput()
len = Length(Curve=flip.Curve)
division = Division(A=A, B=2)
division_2 = Division(A=len, B=division)
tstat = TreeStatistics(Tree=graft(flip.Curve))  # -> Paths, Length, Count
round = Round(Number=division_2)  # -> Nearest, Floor, Ceiling
range = Range(Domain=tstat.Length, Steps=round.Nearest)  # -> simplify(Range)
split = SplitList(List=range, Index="1")  # -> ListA, ListB
num = ClusterInput()
lng = ListLength(List=split.ListB)
subtraction = Subtraction(A=lng, B="1")
num_2 = Number(num)
split_2 = SplitList(List=split.ListB, Index=subtraction)  # -> simplify(ListA), ListB
addition = Addition(A=split.ListA, B=num_2)
subtraction_2 = Subtraction(A=split_2.ListB, B=num_2)
merge = Merge(Data1=simplify(addition), Data2=split_2.ListA, Data3=simplify(subtraction_2))
hframe = HorizontalFrame(Curve=reparameterize(graft(flip_2.Curve)), Parameter=merge)
hframe_2 = HorizontalFrame(Curve=reparameterize(graft(flip.Curve)), Parameter=merge)
dispatch_2 = Dispatch(List=hframe, DispatchPattern=[True, False])  # -> ListA, ListB
dispatch_3 = Dispatch(List=hframe_2, DispatchPattern=[True, False])  # -> ListA, ListB
lng_2 = ListLength(List=dispatch_3.ListB)
subtraction_3 = Subtraction(A=lng_2, B="1")
split_3 = SplitList(List=dispatch_3.ListB, Index=subtraction_3)  # -> simplify(ListA), ListB
split_4 = SplitList(List=dispatch_2.ListA, Index="1")  # -> ListA, ListB
prot = RotatePlane(Plane=split_3.ListB, Angle=degrees("90"))  # -> simplify(Plane)
prot_2 = RotatePlane(Plane=split_4.ListA, Angle=degrees("90"))
merge_2 = Merge(Data1=prot_2, Data2=split_4.ListB)  # -> simplify(Result)
merge_3 = Merge(Data1=split_3.ListA, Data2=prot)

# ---- group: SEQUENCING - WEAVING BRANCHES
data = Data(merge_2)
data_2 = Data(merge_3)
path_mapper = PathMapper(data_2, source="{A}", target="{A;+1}")
viewer = ParamViewer(data)
viewer_2 = ParamViewer(path_mapper)
weave = Weave(Pattern=[0, 1], Stream0=viewer, Stream1=viewer_2, NullGaps=False)
branch = TreeBranch(Tree=[data, path_mapper], Path=weave, MaintainPaths=False)

# ----
B = ClusterOutput(branch)
