# Grasshopper definition ABB_GoFa_robot_playground_RRC-GIS_01.gh (Grasshopper 1.0.7)

# ---- group: Connect to ROS (Robot Operating System)
# Connect to a server for robotic control and simulation
docker_ros_ip = Panel("127.0.0.1")
moveit_ros_server_ip = Panel("128.178.91.174")
rrc_ros_server_ip = Panel("128.178.91.110")
port = Panel("9090")
# This creates a unique Robot object
ros_connect = BooleanToggle(True)
ros_connect_2 = ROSConnect(ip=docker_ros_ip, port=port, connect=ros_connect)  # -> ros_client, is_connected; inputs port: Int32, connect: Boolean
#   port ip: The ip address ROS. Defaults to 127.0.0.1.
#   port port: The port of ROS. Defaults to 9090.
#   port connect: If True, connects to ROS. If False, disconnects from ROS. Defaults to False.
#   port ros_client: The ROS client.
#   port is_connected: True if connection established.
# ---------- ros_connect_2: Python ----------
"""
Connect or disconnect to ROS.

COMPAS FAB v0.26.0
"""
from ghpythonlib.componentbase import executingcomponent as component
from scriptcontext import sticky as st

from compas_fab.backends import RosClient
from compas_fab.ghpython.components import create_id


class ROSConnect(component):
    def RunScript(self, ip, port, connect):
        ros_client = None

        ip = ip or '127.0.0.1'
        port = port or 9090

        key = create_id(self, 'ros_client')
        ros_client = st.get(key, None)

        if ros_client:
            st[key].close()
        if connect:
            st[key] = RosClient(ip, port)
            st[key].run(5)

        ros_client = st.get(key, None)
        is_connected = ros_client.is_connected if ros_client else False
        return (ros_client, is_connected)
# ---------- end ros_connect_2 ----------
panel = Panel(ros_connect_2.is_connected)

# ---- group: Initialize a Robot
load_robot = BooleanToggle(True)
scale_robot = BooleanToggle(True)
units = ValueList({"m": 1, "cm": 100, "mm": 1000}, selected="mm")
ros_robot = ROSRobot(ros_client=ros_connect_2.ros_client, load=load_robot)  # -> robot; inputs load: Boolean
#   port ros_client: The ROS client.
#   port load: If True, loads the robot from ROS. Defaults to False.
# ---------- ros_robot: Python ----------
"""
Load robot directly from ROS.

COMPAS FAB v0.26.0
"""
from compas_ghpython.artists import RobotModelArtist
from ghpythonlib.componentbase import executingcomponent as component
from scriptcontext import sticky as st

from compas_fab.ghpython.components import create_id


class ROSRobot(component):
    def RunScript(self, ros_client, load):
        key = create_id(self, 'robot')
        print(key)
        print(st)
        guid = str(ghenv.Component.InstanceGuid)
        print(guid)
        if ros_client and ros_client.is_connected and load:
            # Load URDF from ROS
            st[key] = ros_client.load_robot(load_geometry=True, precision='24f')
            st[key].artist = RobotModelArtist(st[key].model)

        robot = st.get(key, None)
        if robot:  # client sometimes need to be restarted, without needing to reload geometry
            robot.client = ros_client
        return robot
# ---------- end ros_robot ----------
robot_scale = GhPythonScript(robot=ros_robot, scale_factor=units, enable=scale_robot)  # -> robot
# ---------- robot_scale: Python ----------
from ghpythonlib.componentbase import executingcomponent as component
from scriptcontext import sticky as st

from compas_fab.backends import RosClient
from compas_fab.ghpython.components import create_id

from compas_ghpython.artists import RobotModelArtist
from ghpythonlib.componentbase import executingcomponent as component
from scriptcontext import sticky as st

if enable:
    robot.scale(scale_factor)
# ---------- end robot_scale ----------

# This creates a unique Robot object
load_robot_2 = BooleanToggle(True)
scale_robot_2 = BooleanToggle(True)
units_2 = ValueList({"m": 1, "cm": 100, "mm": 1000}, selected="mm")
ros_robot_2 = ROSRobot(ros_client=ros_connect_2.ros_client, load=load_robot_2)  # -> robot; inputs load: Boolean; same code as ros_robot
robot_scale_2 = GhPythonScript(robot=ros_robot_2, scale_factor=units_2, enable=scale_robot_2)  # -> robot; same code as robot_scale

# ---- group: Setup Info
# Info about the Python environment
info = Info()  # -> info
#   port info: Environment info.
# ---------- info: Python ----------
"""
Displays information about the active COMPAS environment.
"""
import compas_bootstrapper
from ghpythonlib.componentbase import executingcomponent as component

import compas


class CompasInfo(component):
    def RunScript(self):
        self.Message = 'COMPAS v{}'.format(compas.__version__)
        info = 'COMPAS Version: {}\nEnvironment: {}'
        return (info.format(compas.__version__, compas_bootstrapper.ENVIRONMENT_NAME))
# ---------- end info ----------
panel_2 = Panel(info)

# ---- group: forward kinematics
a1 = Slider(47, range=-180..180)
a2 = Slider(0, range=-360..360)
a3 = Slider(0, range=-360..360)
a4 = Slider(0, range=-360..360)
a5 = Slider(0, range=-360..360)
# Inverse Kinematics: the server solves for the robotic pose
#  to reach a given target
a6 = Slider(0, range=-360..360)
# Forward Kinematics: set the rotation of each joint manually
load_presets = Button()
jp = GhPythonScript()  # -> all_joint_value_zero
# ---------- jp: Python ----------
import math
all_joint_value_zero = [0] * 6
print all_joint_value_zero
# ---------- end jp ----------
jp_2 = GhPythonScript()  # -> joint_positions_1
# ---------- jp_2: Python ----------
import math
joint_positions_1 = [0, math.radians(16), math.radians(23), 0, math.radians(52), 0]

print joint_positions_1
# ---------- end jp_2 ----------
forward_kinematics = PythonScript(robot=robot_scale, set_joint_positions=load_presets, joint_positions=jp, a1=a1, a2=a2, a3=a3, a4=a4, a5=a5, a6=a6)  # -> full_configuration; inputs joint_positions: list
# ---------- forward_kinematics: Python ----------
import math
import Grasshopper
from compas.robots import Joint
from compas_fab.robots import Configuration

if set_joint_positions:

    j = 0
    for i in range(ghenv.Component.Params.Input.Count):
        nslider = ghenv.Component.Params.Input[i].Sources[0]
        if nslider.GetType() == Grasshopper.Kernel.Special.GH_NumberSlider:
            nslider.TrySetSliderValue(math.degrees(joint_positions[j]))
            j += 1

if robot:
    joint_positions = [a1, a2, a3, a4, a5, a6]
    joint_types = robot.get_configurable_joint_types()
    for i, joint_type in enumerate(joint_types):
        if joint_type == Joint.REVOLUTE:
            joint_positions[i] = math.radians(joint_positions[i])
    full_configuration = Configuration(joint_positions, joint_types)
# ---------- end forward_kinematics ----------

# ---- group: Simulation from MoveIt / target point
point = Point(<point referenced from the Rhino model>)

# ---- group: Simulation from MoveIt
robot = Data(robot_scale_2)
xy_plane = XYPlane(Origin=point)
zero_config = ZeroConfig(robot=robot)  # -> config
#   port group: If assigned, it will return the zero configuration for the given group, otherwise a full zero configuration.
#   port config: The zero configuration.
# ---------- zero_config: Python ----------
"""
Get a zero configuration for a robot.

COMPAS FAB v0.26.0
"""
from ghpythonlib.componentbase import executingcomponent as component


class ConfigZero(component):
    def RunScript(self, robot, group):

        if robot:
            return robot.zero_configuration(group)

        return None
# ---------- end zero_config ----------
flip_plane = FlipPlane(Plane=xy_plane, ReverseX=False, ReverseY=False, SwapAxes=True)
inverse_kinematics = InverseKinematics(robot=robot, plane=flip_plane, start_configuration=zero_config)  # -> configuration
#   port plane: The plane or frame to calculate the inverse kinematic for.
#   port start_configuration: If passed, calculates the inverse such that the joint positions differ the least from the start_configuration. Defaults to the zero configuration.
#   port group: The planning group used for calculation. Defaults to the robot's main planning group.
#   port configuration: The planning group's configuration.
# ---------- inverse_kinematics: Python ----------
"""
Calculate the robot's inverse kinematic for a given plane.

COMPAS FAB v0.26.0
"""
from compas_rhino.conversions import RhinoPlane
from ghpythonlib.componentbase import executingcomponent as component


class InverseKinematics(component):
    def RunScript(self, robot, plane, start_configuration, group):
        configuration = None
        if robot and robot.client and robot.client.is_connected and plane:
            frame = RhinoPlane.from_geometry(plane).to_compas_frame()
            configuration = robot.inverse_kinematics(frame, start_configuration, group)
        return configuration
# ---------- end inverse_kinematics ----------

# ---- group: Visualize robot
# Visualize the robot
robot_visualize = RobotVisualize(robot=ros_robot, configuration=forward_kinematics)  # -> visual, collision, attached_meshes, frames, base_frame, ee_frame; inputs attached_collision_meshes: list, show_visual: Boolean, show_collision: Boolean, show_frames: Boolean, show_base_frame: Boolean, show_end_effector_frame: Boolean, show_acm: Boolean
#   port group: The planning group used for end-effector and base visualization.
#   port configuration: The robot's full configuration.
#   port attached_collision_meshes: A list of attached collision meshes.
#   port show_visual: Whether or not to show the robot's visual meshes.
#   port show_collision: Whether or not to show the robot's collision meshes.
#   port show_frames: Whether or not to show the robot's joint frames.
#   port show_base_frame: Whether or not to show the robot's base frame.
#   port show_end_effector_frame: Whether or not to show the robot's end-effector frame.
#   port show_acm: Whether or not to show the attached collision meshes (if any).
#   port visual: The robot's visual Rhino meshes (if any).
#   port collision: The robot's collision Rhino meshes (if any).
#   port attached_meshes: The attached collision Rhino meshes (if any).
#   port frames: The robot's joint frames as Rhino planes (if any).
#   port base_frame: The robot's base frame as a Rhino plane (if any).
#   port ee_frame: The robot's end-effector frame as a Rhino plane (if any).
# ---------- robot_visualize: Python ----------
"""
Visualizes the robot.

COMPAS FAB v0.26.0
"""
from compas.geometry import Transformation
from compas_ghpython.artists import FrameArtist
from compas_ghpython.artists import MeshArtist
from ghpythonlib.componentbase import executingcomponent as component


class RobotVisualize(component):
    def RunScript(self, robot, group, configuration, attached_collision_meshes, show_visual, show_collision,
                  show_frames, show_base_frame, show_end_effector_frame, show_acm):

        visual = None
        collision = None
        attached_meshes = None
        frames = None
        base_frame = None
        ee_frame = None

        if robot:
            show_visual = True if show_visual is None else show_visual
            configuration = configuration or robot.zero_configuration()

            robot.update(configuration, visual=show_visual, collision=show_collision)
            compas_frames = robot.transformed_frames(configuration, group)

            if show_visual:
                visual = robot.artist.draw_visual()

            if show_collision:
                collision = robot.artist.draw_collision()

            if show_base_frame:
                base_compas_frame = compas_frames[0]
                artist = FrameArtist(base_compas_frame)
                base_frame = artist.draw()

            if show_end_effector_frame:
                ee_compas_frame = robot.forward_kinematics(configuration, group, options=dict(solver='model'))
                artist = FrameArtist(ee_compas_frame)
                ee_frame = artist.draw()

            if show_frames:
                frames = []
                for compas_frame in compas_frames[1:]:
                    artist = FrameArtist(compas_frame)
                    frame = artist.draw()
                    frames.append(frame)

            if show_acm:
                attached_meshes = []
                for acm in attached_collision_meshes:
                    frame = robot.forward_kinematics(configuration, options=dict(solver='model', link=acm.link_name))
                    T = Transformation.from_frame_to_frame(acm.collision_mesh.frame, frame)
                    mesh = acm.collision_mesh.mesh.transformed(T)
                    attached_meshes.append(MeshArtist(mesh).draw())

        return (visual, collision, attached_meshes, frames, base_frame, ee_frame)
# ---------- end robot_visualize ----------
mesh = Mesh(robot_visualize.visual)

# Visualize the robot
robot_visualize_2 = RobotVisualize(robot=robot, configuration=inverse_kinematics)  # -> visual, collision, attached_meshes, frames, base_frame, ee_frame; inputs attached_collision_meshes: list, show_visual: Boolean, show_collision: Boolean, show_frames: Boolean, show_base_frame: Boolean, show_end_effector_frame: Boolean, show_acm: Boolean; same code as robot_visualize
mesh_2 = Mesh(robot_visualize_2.visual)
